# Grasshopper definition HoberGlow_Public_Framework.ghx (Grasshopper 1.0.8)
# plug-ins: Karamba3D

# ---- group: 01 SHARED INPUTS
b_parts_input = Geometry()
center_axis_input = Curve()
a_axis_1_input = Curve()
a_axis_2_input = Curve()
b_axis_1_input = Curve()
b_axis_2_input = Curve()
mechanism_angle_theta_deg = Slider(101.52, range=1..140)
a_parts_input = Geometry()
total_ring_load_kn = Slider(0.01, range=0..50)

# ---- group: 02 DYNAMIC MECHANISM + OPTICAL ANALYSIS
# READ THIS FIRST — BIND YOUR OWN GEOMETRY: PUBLIC FRAMEWORK RELEASE — PROPRIETARY PRODUCT GEOMETRY IS NOT INCLUDED
# The original product/appearance model was purchased by the sponsoring company.
# All referenced geometry inputs have therefore been cleared.
# Bind your own skeleton, rings, guides, petals and light geometry to the named inputs.
# 
# STRUCTURAL BRANCH: 1/8 cyclic-sector proxy with 5 active elements.
# DYNAMIC BRANCH: Assembly viewport preview + Dynamic Mechanism Report.
# OPTICAL BRANCH: OpticalPreview + Optical Analysis Report.
# The proxy is for workflow demonstration and relative comparison, not certification.
upper_travel = Slider(4.6, range=1..140)
lower_travel = Slider(-10, range=-10..140)
upper_guide_input = Curve()
upper_petal_input = Geometry()
upper_ring_input = Geometry()
lower_guide_input = Curve()
lower_petal_input = Geometry()
lower_ring_input = Geometry()
light_geometry_1 = Geometry()
light_geometry_2 = Geometry()
light_geometry_3 = Geometry()
merge_light_geometry = Merge(Data1=light_geometry_1, Data2=light_geometry_2, Data3=light_geometry_3)
flatten_light_geometry = FlattenTree(Tree=merge_light_geometry, Path="{0}")
# FINAL OUTPUT DASHBOARD: PRIMARY: Maximum Displacement [cm]
# RESPONSE: Maximum Resultant Force [kN]
# CHECK: Reactions balance applied sector load
# DESIGN: N, Vy, Vz, Mt, My, Mz maxima
# NOTE: Do not read viewport preview colors as final values.
dynamic_mechanism_optical_analysis = Python3Script(
    Theta=mechanism_angle_theta_deg,
    UpperTravel=upper_travel,
    LowerTravel=lower_travel,
    A_geo=flatten(a_parts_input),
    B_geo=flatten(b_parts_input),
    C_axis=center_axis_input,
    A_axis1=a_axis_1_input,
    A_axis2=a_axis_2_input,
    B_axis1=b_axis_1_input,
    B_axis2=b_axis_2_input,
    UpperPetal=flatten(upper_petal_input),
    UpperRing=upper_ring_input,
    UpperGuide=upper_guide_input,
    LowerPetal=flatten(lower_petal_input),
    LowerRing=lower_ring_input,
    LowerGuide=lower_guide_input,
    LightGeo=flatten(flatten_light_geometry))  # -> Assembly, Report, OpticalPreview, OpticalReport, AssemblyCenter, AssemblyAxis, AssemblyPlane, a, b; inputs Theta: Double, UpperTravel: Double, LowerTravel: Double, A_geo: tree of GeometryBase, B_geo: tree of GeometryBase, C_axis: Curve, A_axis1: Curve, A_axis2: Curve, B_axis1: Curve, B_axis2: Curve, UpperPetal: tree of GeometryBase, UpperRing: GeometryBase, UpperGuide: Curve, LowerPetal: tree of GeometryBase, LowerRing: GeometryBase, LowerGuide: list of Curve, LightGeo: tree of GeometryBase
# ---------- dynamic_mechanism_optical_analysis: Python ----------
import math
import Rhino
import Rhino.Geometry as rg
from Rhino.Geometry.Intersect import Intersection

# ============================================================
# HoberGlow ALL-IN-ONE V26 — AUTHORITATIVE MECHANISM + FEA JOINT EXPORT
# Rhino 8 / Grasshopper Python 3
#
# PURPOSE
# ------------------------------------------------------------
# Reuse the user's EXISTING Python component shell.
#
# EXISTING INPUTS are kept:
#   ThetaMin
#   ThetaMax
#   Step
#   A_geo
#   B_geo
#   C_axis
#   A_axis1
#   A_axis2
#   B_axis1
#   B_axis2
#
# ONLY SIX NEW INPUTS are added:
#   UpperPetal
#   UpperRing
#   UpperGuide
#   LowerPetal
#   LowerRing
#   LowerGuide
#
# IMPORTANT:
#   Rename the first three existing inputs:
#
#       ThetaMin -> Theta
#       ThetaMax -> UpperTravel
#       Step     -> LowerTravel
#
#   Theta drives the main ring.
#   UpperTravel / LowerTravel control maximum guide travel
#   around the two canopy rings.
#
# EXISTING OUTPUTS are also reused:
#
#   CheckTheta_list      -> current Theta
#   Zone_list            -> [UpperTilt, LowerTilt]
#   OverlapPairs_list    -> canopy interference details
#   MinBBoxGap_list      -> [Upper P/Ring error, Lower P/Ring error]
#   ClosestPair_list     -> short status information
#   Result_list          -> COMPLETE LIVE GEOMETRY
#                           main A/B ring + 2-layer canopy + fixed rings
#   ExactCheckTheta_list -> [48, 88.623, 107]
#   Rows                 -> generated local hinge axes
#   Summary              -> one readable report
#
# So:
#   Result_list -> Custom Preview
# gives one complete live assembly.
#
# ============================================================
# FINAL CANOPY DEFINITION
# ------------------------------------------------------------
# TWO layers.
#
# Each layer uses ONE master petal + ONE solid circular Ring +
# ONE black Guide Line.
#
# The Guide Line endpoint nearest the Ring is the moving end.
# That end slides around the circular Ring.
# The other Guide endpoint is treated as a geometric reference.
#
# The master petal follows the change of Guide Line pose using
# a rigid PlaneToPlane transform (NO SCALE / NO MORPH).
#
# This is a GEOMETRIC DRIVER, not a claim that the black line
# is a physical rigid linkage.
# ============================================================


# ------------------------------------------------------------
# 0. OUTPUT INITIALISATION
# ------------------------------------------------------------

CheckTheta_list = []
Zone_list = []
OverlapPairs_list = []
MinBBoxGap_list = []
ClosestPair_list = []
Result_list = []
ExactCheckTheta_list = [48.0, 88.623, 107.0]
Rows = []
Summary = []

# New optical outputs
OpticalGeo = []
OpticalSummary = []

# Shared global datum for downstream FEA.
# AssemblyCenter is the corrected full-luminaire centre already derived
# from the authored UpperRing + LowerRing geometry.
AssemblyCenter = None
AssemblyAxis = None
AssemblyPlane = None

# AUTHORITATIVE FEA GEOMETRY EXPORT
# Flat lists, 3 points per physical member:
#   [End1, C, End2] * 8
# These points are transformed by the EXACT SAME PlaneToPlane transforms
# used to move the visible A/B Rhino geometry.
FEA_AJoints = []
FEA_BJoints = []
FEA_PinAxis = None
FEA_Theta = None


# ------------------------------------------------------------
# 1. DESIGN CONSTANTS
# ------------------------------------------------------------

N = 8

THETA_OPEN = 48.0
THETA_CLOSED = 107.0
THETA_REF = 101.519817

# Default guide travel if an input is left empty.
# Units: degrees around the corresponding circular ring.
# Positive / negative controls travel direction.
DEFAULT_UPPER_TRAVEL = 12.0
DEFAULT_LOWER_TRAVEL = -8.0

# Heavy canopy interference checking is automatically executed
# only near these three portfolio states, keeping live dragging light.
CHECK_STATES = [48.0, 88.623, 107.0]
CHECK_ANGLE_TOL = 0.03

# ------------------------------------------------------------
# LIGHT-FIELD PROXY SETTINGS
# ------------------------------------------------------------
# No IES / lumen / material BRDF is available, so this is a
# normalized one-bounce geometric optical proxy.
#
# The work plane is placed at a scale-relative distance below
# the main mechanism. No physical lux values are reported.
OPTICAL_STATES = [
    ("OPEN", 48.0),
    ("MID", 88.623),
    ("CLOSED", 107.0)
]

LIGHT_CONE_HALF_ANGLE_DEG = 25.0

# Rays per emitter:
# 1 centre + 8 + 12 + 16 = 37
LIGHT_RAY_RING_COUNTS = [
    (0.0, 1),
    (0.33, 8),
    (0.66, 12),
    (1.0, 16)
]

# Preview only every Nth ray, while metrics use all rays.
OPTICAL_PREVIEW_STRIDE = 4

# Virtual work-plane offset = source-canopy diameter * factor.
OPTICAL_FLOOR_DROP_FACTOR = 6.0


# ------------------------------------------------------------
# 2. BASIC HELPERS
# ------------------------------------------------------------

def clamp(x, lo, hi):
    return max(lo, min(hi, x))


def dot(v1, v2):
    return rg.Vector3d.Multiply(
        rg.Vector3d(v1),
        rg.Vector3d(v2)
    )


def cross2(ax, ay, bx, by):
    return ax * by - ay * bx


def dist2(a, b):
    dx = a[0] - b[0]
    dy = a[1] - b[1]
    return math.sqrt(dx * dx + dy * dy)


def add2(a, b):
    return (
        a[0] + b[0],
        a[1] + b[1]
    )


def sub2(a, b):
    return (
        a[0] - b[0],
        a[1] - b[1]
    )


def rot2(pt, angle):
    x, y = pt
    c = math.cos(angle)
    s = math.sin(angle)

    return (
        c * x - s * y,
        s * x + c * y
    )


def solve_2x2(a, b, c, d, e, f):
    det = a * d - b * c

    if abs(det) < 1e-12:
        raise ValueError(
            "Kinematic matrix is singular."
        )

    return (
        (e * d - b * f) / det,
        (a * f - e * c) / det
    )


def smoothstep(t):
    t = clamp(t, 0.0, 1.0)
    return t * t * (3.0 - 2.0 * t)


def unwrap_gh_value(value):
    """
    Best-effort unwrap for Grasshopper goo.
    With GeometryBase Type Hint, values are normally already Rhino geometry,
    but this keeps the script tolerant of wrapped inputs.
    """
    if value is None:
        return None

    if isinstance(
        value,
        rg.GeometryBase
    ):
        return value

    try:
        v = value.Value

        if isinstance(
            v,
            rg.GeometryBase
        ):
            return v
    except:
        pass

    return value


def tree_input_meta(value):
    """
    Return (branch_count, item_count, mode_string) without changing data.
    Useful for verifying that Tree Access is actually active.
    """
    if value is None:
        return 0, 0, "EMPTY"

    # Grasshopper DataTree / GH_Structure style.
    try:
        bc = int(
            value.BranchCount
        )

        try:
            dc = int(
                value.DataCount
            )
        except:
            dc = 0

            try:
                for branch in value.Branches:
                    dc += len(
                        branch
                    )
            except:
                pass

        return bc, dc, "TREE"

    except:
        pass

    # Rhino geometry as a single item.
    if isinstance(
        value,
        rg.GeometryBase
    ):
        return 1, 1, "ITEM"

    # Normal iterable / List Access fallback.
    try:
        data = list(
            value
        )

        return 1, len(
            data
        ), "LIST"

    except:
        return 1, 1, "ITEM"


def as_geo_list(value):
    """
    TREE-SAFE geometry collector.

    Intended input mode for:
        A_geo
        B_geo
        UpperPetal
        LowerPetal
        LightGeo

    is:
        Parameter Access = Tree
        Type Hint        = GeometryBase

    If a Grasshopper DataTree is received, ALL branches are collected
    internally into one flat Python list. This prevents the script from
    receiving one branch at a time and producing 12 separate solutions.
    """
    if value is None:
        return []

    if isinstance(
        value,
        rg.GeometryBase
    ):
        return [
            value
        ]

    raw = None

    # Grasshopper.DataTree<T>.AllData()
    try:
        raw = list(
            value.AllData()
        )
    except:
        raw = None

    # Fallback for structures exposing Branches but not AllData().
    if raw is None:
        try:
            raw = []

            for branch in value.Branches:
                for item in branch:
                    raw.append(
                        item
                    )
        except:
            raw = None

    # Ordinary List Access fallback.
    if raw is None:
        try:
            raw = list(
                value
            )
        except:
            raw = [
                value
            ]

    result = []

    for item in raw:
        item = unwrap_gh_value(
            item
        )

        if item is None:
            continue

        if isinstance(
            item,
            rg.GeometryBase
        ):
            result.append(
                item
            )

    return result


def duplicate_geo(g):
    if g is None:
        return None

    if isinstance(g, rg.Brep):
        return g.DuplicateBrep()

    if isinstance(g, rg.Mesh):
        return g.DuplicateMesh()

    if isinstance(g, rg.SubD):
        try:
            return g.DuplicateSubD()
        except:
            return g.Duplicate()

    if isinstance(g, rg.Curve):
        return g.DuplicateCurve()

    return g.Duplicate()


def transform_group(geos, xform):
    result = []

    for geo in geos:
        dup = duplicate_geo(
            geo
        )

        if dup is None:
            continue

        if not dup.Transform(
            xform
        ):
            raise ValueError(
                "Rigid geometry transform failed."
            )

        result.append(
            dup
        )

    return result


# ------------------------------------------------------------
# 3. MAIN FIVE-AXIS CALIBRATION
# ------------------------------------------------------------

def as_line(axis_input, name, tol):
    if axis_input is None:
        raise ValueError(
            "{} is empty."
            .format(name)
        )

    if isinstance(axis_input, rg.Line):
        ln = rg.Line(
            axis_input.From,
            axis_input.To
        )

    elif isinstance(axis_input, rg.Curve):
        if not axis_input.IsLinear(tol):
            raise ValueError(
                "{} must be a straight line."
                .format(name)
            )

        ln = rg.Line(
            axis_input.PointAtStart,
            axis_input.PointAtEnd
        )

    else:
        raise ValueError(
            "{} must be a Line / linear Curve."
            .format(name)
        )

    if (
        not ln.IsValid
        or
        ln.Length <= tol
    ):
        raise ValueError(
            "{} is invalid or too short."
            .format(name)
        )

    return ln


def infinite_line_plane_point(
    line,
    plane_origin,
    plane_normal
):
    p0 = line.From
    d = line.Direction
    n = rg.Vector3d(
        plane_normal
    )

    denom = dot(
        d,
        n
    )

    if abs(denom) < 1e-12:
        raise ValueError(
            "A hinge axis is parallel to the datum plane."
        )

    t = dot(
        plane_origin - p0,
        n
    ) / denom

    return line.PointAt(
        t
    )


def point_xy(pt, origin, xaxis, yaxis):
    v = pt - origin

    return (
        dot(v, xaxis),
        dot(v, yaxis)
    )


def included_angle_deg(v1, v2):
    a = rg.Vector3d(
        v1
    )

    b = rg.Vector3d(
        v2
    )

    a.Unitize()
    b.Unitize()

    d = clamp(
        dot(a, b),
        -1.0,
        1.0
    )

    return math.degrees(
        math.acos(d)
    )


def fit_bar(
    C,
    end1,
    end2,
    datum_x,
    datum_y,
    delta
):
    """
    Least-squares fit to the exact N=8 compatible whole rigid bar.
    """

    p1 = point_xy(
        end1,
        C,
        datum_x,
        datum_y
    )

    p2 = point_xy(
        end2,
        C,
        datum_x,
        datum_y
    )

    u1 = (
        1.0,
        0.0
    )

    u2 = (
        -math.cos(delta),
        -math.sin(delta)
    )

    candidates = [
        (p1, p2, False),
        (p2, p1, True)
    ]

    best = None

    for pA, pB, swapped in candidates:

        sum_dot = (
            u1[0] * pA[0]
            + u1[1] * pA[1]
            + u2[0] * pB[0]
            + u2[1] * pB[1]
        )

        sum_cross = (
            cross2(
                u1[0],
                u1[1],
                pA[0],
                pA[1]
            )
            +
            cross2(
                u2[0],
                u2[1],
                pB[0],
                pB[1]
            )
        )

        beta = math.atan2(
            sum_cross,
            sum_dot
        )

        cb = math.cos(
            beta
        )

        sb = math.sin(
            beta
        )

        r1 = (
            cb,
            sb
        )

        r2 = (
            cb * u2[0]
            - sb * u2[1],
            sb * u2[0]
            + cb * u2[1]
        )

        L = 0.5 * (
            r1[0] * pA[0]
            + r1[1] * pA[1]
            + r2[0] * pB[0]
            + r2[1] * pB[1]
        )

        if L <= 0.0:
            continue

        pred1 = (
            L * r1[0],
            L * r1[1]
        )

        pred2 = (
            L * r2[0],
            L * r2[1]
        )

        e1 = dist2(
            pred1,
            pA
        )

        e2 = dist2(
            pred2,
            pB
        )

        rms = math.sqrt(
            0.5 * (
                e1 * e1
                + e2 * e2
            )
        )

        candidate = {
            "L": L,
            "beta": beta,
            "rms": rms,
            "swapped": swapped
        }

        if (
            best is None
            or
            rms < best["rms"]
        ):
            best = candidate

    if best is None:
        raise ValueError(
            "Could not fit a rigid bar."
        )

    return best


def source_frame_from_fit(
    C,
    datum_x,
    datum_y,
    fit
):
    beta = fit[
        "beta"
    ]

    cb = math.cos(
        beta
    )

    sb = math.sin(
        beta
    )

    x = (
        rg.Vector3d(
            datum_x
        ) * cb
        +
        rg.Vector3d(
            datum_y
        ) * sb
    )

    y = (
        rg.Vector3d(
            datum_x
        ) * (-sb)
        +
        rg.Vector3d(
            datum_y
        ) * cb
    )

    x.Unitize()
    y.Unitize()

    return rg.Plane(
        C,
        x,
        y
    )


def target_frame_in_datum(
    assembly_center,
    datum_x,
    datum_y,
    ox,
    oy,
    angle
):
    """
    Build target bar frame in the ORIGINAL Rhino datum.
    """
    origin = (
        assembly_center
        + rg.Vector3d(datum_x) * ox
        + rg.Vector3d(datum_y) * oy
    )

    ca = math.cos(angle)
    sa = math.sin(angle)

    x = (
        rg.Vector3d(datum_x) * ca
        + rg.Vector3d(datum_y) * sa
    )

    y = (
        rg.Vector3d(datum_x) * (-sa)
        + rg.Vector3d(datum_y) * ca
    )

    x.Unitize()
    y.Unitize()

    return rg.Plane(
        origin,
        x,
        y
    )


def solve_main_state(
    theta_deg,
    LA,
    LB,
    delta,
    N
):
    theta = math.radians(
        theta_deg
    )

    a2 = (
        -LA * math.cos(delta),
        -LA * math.sin(delta)
    )

    b1 = (
        LB,
        0.0
    )

    Rdb1 = rot2(
        b1,
        theta + delta
    )

    rhs = sub2(
        a2,
        Rdb1
    )

    cd = math.cos(
        delta
    )

    sd = math.sin(
        delta
    )

    C0 = solve_2x2(
        cd - 1.0,
        -sd,
        sd,
        cd - 1.0,
        rhs[0],
        rhs[1]
    )

    bars = []

    for i in range(
        N
    ):
        ai = (
            i * delta
        )

        bi = (
            theta
            + i * delta
        )

        Ci = rot2(
            C0,
            ai
        )

        bars.append({
            "id": "A{}".format(i),
            "kind": "A",
            "origin": Ci,
            "angle": ai
        })

        bars.append({
            "id": "B{}".format(i),
            "kind": "B",
            "origin": Ci,
            "angle": bi
        })

    Rc = math.sqrt(
        C0[0] * C0[0]
        +
        C0[1] * C0[1]
    )

    return {
        "bars": bars,
        "Rc": Rc
    }


# ------------------------------------------------------------
# 4. CANOPY: CIRCULAR RING + BLACK GUIDE LINE
# ------------------------------------------------------------

def extract_single_input_value(value):
    """
    Robustly unwrap one expected Grasshopper input.

    This is intentionally used ONLY for single-value inputs such as:
        UpperRing
        LowerRing
        UpperGuide
        LowerGuide

    It accepts:
        Rhino.Geometry
        GH goo with .Value
        one-item Python list/tuple
        one-item / one-branch DataTree

    If a tree/list contains several values, the first non-null value is used.
    That keeps old GH files compatible after switching other ports to Tree Access.
    """

    if value is None:
        return None

    # Already a Rhino value.
    if isinstance(
        value,
        (
            rg.GeometryBase,
            rg.Line
        )
    ):
        return value

    # Grasshopper goo wrapper, e.g. GH_Curve / GH_Brep / GH_Line.
    try:
        wrapped = value.Value

        if wrapped is not None:
            return extract_single_input_value(
                wrapped
            )
    except:
        pass

    # Grasshopper DataTree / GH_Structure.
    try:
        data = list(
            value.AllData()
        )

        for item in data:
            result = extract_single_input_value(
                item
            )

            if result is not None:
                return result
    except:
        pass

    # Structure exposing Branches but not AllData().
    try:
        for branch in value.Branches:
            for item in branch:
                result = extract_single_input_value(
                    item
                )

                if result is not None:
                    return result
    except:
        pass

    # Normal iterable fallback.
    try:
        for item in value:
            result = extract_single_input_value(
                item
            )

            if result is not None:
                return result
    except:
        pass

    return value


def as_curve(value, name):
    value = extract_single_input_value(
        value
    )

    if value is None:
        raise ValueError(
            "{} is empty."
            .format(
                name
            )
        )

    if isinstance(
        value,
        rg.Curve
    ):
        return value

    if isinstance(
        value,
        rg.Line
    ):
        return rg.LineCurve(
            value
        )

    # Some Grasshopper/Rhino wrappers can be converted to curve-like geometry.
    try:
        if isinstance(
            value,
            rg.GeometryBase
        ):
            dup = value.Duplicate()

            if isinstance(
                dup,
                rg.Curve
            ):
                return dup
    except:
        pass

    raise ValueError(
        "{} must resolve to ONE Curve / Line; received {}."
        .format(
            name,
            type(
                value
            ).__name__
        )
    )


def as_brep(value, name):
    value = extract_single_input_value(
        value
    )

    if value is None:
        raise ValueError(
            "{} is empty."
            .format(
                name
            )
        )

    if isinstance(
        value,
        rg.Brep
    ):
        return value

    try:
        brep = rg.Brep.TryConvertBrep(
            value
        )
    except:
        brep = None

    if brep is None:
        raise ValueError(
            "{} must resolve to ONE Brep / solid-like GeometryBase; received {}."
            .format(
                name,
                type(
                    value
                ).__name__
            )
        )

    return brep


def percentile(values, q):
    if not values:
        return None

    vals = sorted(values)

    if len(vals) == 1:
        return vals[0]

    pos = (
        len(vals) - 1
    ) * q

    lo = int(
        math.floor(pos)
    )

    hi = int(
        math.ceil(pos)
    )

    if lo == hi:
        return vals[lo]

    t = (
        pos - lo
    )

    return (
        vals[lo] * (1.0 - t)
        + vals[hi] * t
    )


def ring_solid_center_circle(
    ring_geo,
    axis_normal,
    name,
    tol
):
    """
    Extract a virtual circular centre-path from the ACTUAL SOLID ring.

    1. Convert the ring to Brep.
    2. Section it through its middle with a plane perpendicular
       to the main C_axis.
    3. Sample the resulting inner / outer circular section curves.
    4. Average the inner / outer radii.

    The user does NOT need to draw a centreline curve.
    """

    brep = as_brep(
        ring_geo,
        name
    )

    bb = brep.GetBoundingBox(
        True
    )

    if not bb.IsValid:
        raise ValueError(
            "{} bounding box is invalid."
            .format(name)
        )

    center = rg.Point3d(
        0.5 * (bb.Min.X + bb.Max.X),
        0.5 * (bb.Min.Y + bb.Max.Y),
        0.5 * (bb.Min.Z + bb.Max.Z)
    )

    n = rg.Vector3d(
        axis_normal
    )

    if n.IsTiny():
        raise ValueError(
            "Main C_axis direction is invalid."
        )

    n.Unitize()

    section_plane = rg.Plane(
        center,
        n
    )

    result = Intersection.BrepPlane(
        brep,
        section_plane,
        tol
    )

    if not isinstance(
        result,
        tuple
    ):
        raise ValueError(
            "{} BrepPlane returned an unexpected result."
            .format(name)
        )

    if (
        len(result) < 3
        or
        not result[0]
    ):
        raise ValueError(
            "Could not section {} through its mid-plane."
            .format(name)
        )

    curves = result[1]

    if (
        curves is None
        or
        len(curves) == 0
    ):
        raise ValueError(
            "{} mid-plane produced no section curves."
            .format(name)
        )

    radii = []

    for crv in curves:

        if crv is None:
            continue

        params = crv.DivideByCount(
            48,
            True
        )

        if (
            params is None
            or
            len(params) == 0
        ):
            pts = [
                crv.PointAtStart,
                crv.PointAtEnd
            ]
        else:
            pts = [
                crv.PointAt(t)
                for t in params
            ]

        for pt in pts:

            v = rg.Vector3d(
                pt - center
            )

            axial = dot(
                v,
                n
            )

            planar = (
                v
                - n * axial
            )

            r = planar.Length

            if r > tol:
                radii.append(
                    r
                )

    if len(radii) < 8:
        raise ValueError(
            "Not enough section samples from {}."
            .format(name)
        )

    rs = sorted(
        radii
    )

    # Find the strongest split between inner and outer radius bands.
    best_i = None
    best_gap = -1.0

    for i in range(
        1,
        len(rs)
    ):

        gap = (
            rs[i]
            - rs[i - 1]
        )

        if gap > best_gap:
            best_gap = gap
            best_i = i

    if (
        best_i is None
        or
        best_i <= 0
        or
        best_i >= len(rs)
    ):
        raise ValueError(
            "Could not separate inner / outer radius bands for {}."
            .format(name)
        )

    inner_cluster = rs[:best_i]
    outer_cluster = rs[best_i:]

    r_inner = percentile(
        inner_cluster,
        0.5
    )

    r_outer = percentile(
        outer_cluster,
        0.5
    )

    if (
        r_inner is None
        or
        r_outer is None
        or
        r_outer <= r_inner
    ):
        raise ValueError(
            "Invalid extracted ring radii for {}."
            .format(name)
        )

    r_center = 0.5 * (
        r_inner
        + r_outer
    )

    circle = rg.Circle(
        section_plane,
        r_center
    )

    return {
        "brep": brep,
        "circle": circle,
        "r_inner": r_inner,
        "r_outer": r_outer,
        "r_center": r_center
    }


def endpoint_ring_distance(
    ring_data,
    pt
):
    """
    Distance from point to the extracted circular centre-path.
    Only used to decide which black-line endpoint is the ring-side end.
    """

    circle = ring_data[
        "circle"
    ]

    center = circle.Center

    normal = rg.Vector3d(
        circle.Normal
    )

    normal.Unitize()

    v = rg.Vector3d(
        pt - center
    )

    axial = dot(
        v,
        normal
    )

    planar = (
        v
        - normal * axial
    )

    radial = planar.Length

    return math.sqrt(
        (radial - circle.Radius) ** 2
        + axial ** 2
    )


def guide_source_data(
    ring_geo,
    guide,
    ring_name,
    guide_name,
    axis_normal,
    tol
):
    """
    Ring input = ACTUAL SOLID.

    The line endpoint closer to the extracted ring centre-path
    becomes the moving endpoint.

    IMPORTANT:
    The endpoint itself is NOT snapped to the centre-path.
    Its real radial / vertical offset is preserved while it
    moves around the ring axis.
    """

    guide = as_curve(
        guide,
        guide_name
    )

    if not guide.IsLinear(
        tol
    ):
        raise ValueError(
            "{} must be a straight black reference line."
            .format(guide_name)
        )

    ring_data = ring_solid_center_circle(
        ring_geo,
        axis_normal,
        ring_name,
        tol
    )

    A = guide.PointAtStart
    B = guide.PointAtEnd

    dA = endpoint_ring_distance(
        ring_data,
        A
    )

    dB = endpoint_ring_distance(
        ring_data,
        B
    )

    if dA <= dB:
        moving_raw = A
        fixed = B
        centreline_distance = dA
    else:
        moving_raw = B
        fixed = A
        centreline_distance = dB

    return {
        "guide": guide,
        "ring_data": ring_data,
        "circle": ring_data[
            "circle"
        ],
        "P0": moving_raw,
        "F": fixed,
        "centreline_distance": centreline_distance
    }


def guide_frame(
    P,
    F,
    ring_normal,
    label
):
    """
    One black line alone does not define roll.
    We use the ring normal as the second frame reference.

    Origin = moving point P on Ring
    X      = P -> fixed reference endpoint F
    Y/Z    = completed with ring normal
    """

    x = rg.Vector3d(
        F - P
    )

    if x.IsTiny():
        raise ValueError(
            "{} guide has zero usable direction."
            .format(label)
        )

    x.Unitize()

    n = rg.Vector3d(
        ring_normal
    )

    n.Unitize()

    y = rg.Vector3d.CrossProduct(
        n,
        x
    )

    if y.IsTiny():
        raise ValueError(
            "{} guide is parallel to ring normal."
            .format(label)
        )

    y.Unitize()

    z = rg.Vector3d.CrossProduct(
        x,
        y
    )

    z.Unitize()

    return rg.Plane(
        P,
        x,
        y
    )


def ring_move_point(
    circle,
    P0,
    angle_deg
):
    xf = rg.Transform.Rotation(
        math.radians(
            angle_deg
        ),
        circle.Normal,
        circle.Center
    )

    P1 = rg.Point3d(
        P0
    )

    P1.Transform(
        xf
    )

    return P1


def travel_at_theta(
    theta,
    max_travel_deg
):
    """
    CLOSED = 107 -> 0 travel
    OPEN   = 48  -> max travel

    Smoothstep is used only to make the live motion calmer.
    """

    denom = (
        THETA_CLOSED
        - THETA_OPEN
    )

    u = (
        THETA_CLOSED
        - theta
    ) / denom

    u = smoothstep(
        clamp(
            u,
            0.0,
            1.0
        )
    )

    return (
        max_travel_deg
        * u
    )



def petal_outer_point(
    petal_geo,
    P
):
    """
    Find a representative outer point of the petal.
    Used only to determine which tangent-axis rotation sign
    raises the petal outer edge.
    """

    mesh = group_to_mesh(
        petal_geo
    )

    if mesh is not None:
        best = None
        best_d = -1.0

        for i in range(
            mesh.Vertices.Count
        ):
            pt = mesh.Vertices.Point3dAt(
                i
            )

            d = pt.DistanceTo(
                P
            )

            if d > best_d:
                best_d = d
                best = pt

        if best is not None:
            return best

    bb = geometry_bbox(
        petal_geo
    )

    if bb is None:
        raise ValueError(
            "Could not determine petal outer point."
        )

    best = None
    best_d = -1.0

    for pt in bb.GetCorners():
        d = pt.DistanceTo(
            P
        )

        if d > best_d:
            best_d = d
            best = pt

    return best


def local_ring_tangent_axis(
    circle,
    P
):
    """
    Tangent axis through the REAL guide/root point P.

    Direction is tangent to the extracted virtual ring centre-path,
    but the axis itself passes through the actual point P on/near
    the physical ring surface.
    """

    n = rg.Vector3d(
        circle.Normal
    )

    n.Unitize()

    radial = rg.Vector3d(
        P - circle.Center
    )

    axial = dot(
        radial,
        n
    )

    radial = (
        radial
        - n * axial
    )

    if radial.IsTiny():
        raise ValueError(
            "Cannot derive local ring tangent at Guide endpoint."
        )

    radial.Unitize()

    tangent = rg.Vector3d.CrossProduct(
        n,
        radial
    )

    if tangent.IsTiny():
        raise ValueError(
            "Local ring tangent is invalid."
        )

    tangent.Unitize()

    return tangent


def upward_flip_sign(
    petal_geo,
    P,
    tangent
):
    """
    Test +1 / -1 degree about the tangent hinge.
    Choose whichever raises the petal outer edge more in World Z.
    """

    outer = petal_outer_point(
        petal_geo,
        P
    )

    angle = math.radians(
        1.0
    )

    xp = rg.Transform.Rotation(
        angle,
        tangent,
        P
    )

    xn = rg.Transform.Rotation(
        -angle,
        tangent,
        P
    )

    pp = rg.Point3d(
        outer
    )

    pn = rg.Point3d(
        outer
    )

    pp.Transform(
        xp
    )

    pn.Transform(
        xn
    )

    if pp.Z >= pn.Z:
        return 1.0

    return -1.0


def guide_driven_transform(
    petal_geo,
    ring,
    guide,
    ring_name,
    guide_name,
    theta,
    max_travel_deg,
    axis_normal,
    tol
):
    """
    CORRECTED KINEMATICS

    The black line is a cable/guide proxy.

    Its ring-side endpoint travels around the solid ring,
    BUT the petal does NOT follow that line with PlaneToPlane.

    Instead:
      Guide ring travel -> scalar pull amount
      scalar pull amount -> petal FLIP angle
      petal rotates about the LOCAL TANGENT AXIS through P

    Therefore the petal flips upward rather than yawing around
    the centre of the ring.
    """

    data = guide_source_data(
        ring,
        guide,
        ring_name,
        guide_name,
        axis_normal,
        tol
    )

    circle = data[
        "circle"
    ]

    P0 = data[
        "P0"
    ]

    F = data[
        "F"
    ]

    ref_travel = travel_at_theta(
        THETA_REF,
        max_travel_deg
    )

    target_travel = travel_at_theta(
        theta,
        max_travel_deg
    )

    delta_travel = (
        target_travel
        - ref_travel
    )

    # --------------------------------------------------------
    # Debug / cable guide movement around the ring
    # --------------------------------------------------------

    P1 = ring_move_point(
        circle,
        P0,
        delta_travel
    )

    target_guide = rg.LineCurve(
        F,
        P1
    )

    # --------------------------------------------------------
    # REAL PETAL MOTION = FLIP ABOUT LOCAL TANGENT HINGE
    # --------------------------------------------------------

    tangent = local_ring_tangent_axis(
        circle,
        P0
    )

    flip_sign = upward_flip_sign(
        petal_geo,
        P0,
        tangent
    )

    # Travel sign only controls cable motion direction around Ring.
    # Petal opening itself always flips upward.
    #
    # |travel angle| is used as a lightweight design proxy for
    # flip angle, keeping the current component simple.
    ref_flip = abs(
        ref_travel
    )

    target_flip = abs(
        target_travel
    )

    delta_flip = (
        target_flip
        - ref_flip
    )

    xf = rg.Transform.Rotation(
        math.radians(
            delta_flip
            * flip_sign
        ),
        tangent,
        P0
    )

    # Useful physical proxy for later portfolio diagrams:
    # cable arc displacement on the virtual centre path.
    cable_arc = (
        circle.Radius
        * math.radians(
            target_travel
        )
    )

    delta_cable_arc = (
        circle.Radius
        * math.radians(
            delta_travel
        )
    )

    return {
        "xform": xf,
        "sourceP": P0,
        "targetP": P1,
        "fixedP": F,
        "sourceGuide": data["guide"],
        "targetGuide": target_guide,
        "circle": circle,
        "centrelineDistance": data["centreline_distance"],
        "ringInnerRadius": data["ring_data"]["r_inner"],
        "ringOuterRadius": data["ring_data"]["r_outer"],
        "ringCenterRadius": data["ring_data"]["r_center"],
        "travel": target_travel,
        "deltaTravel": delta_travel,
        "flip": target_flip,
        "deltaFlip": delta_flip,
        "flipSign": flip_sign,
        "hingeTangent": tangent,
        "cableArc": cable_arc,
        "deltaCableArc": delta_cable_arc
    }


def circle_array_transform(
    circle,
    index,
    n
):
    angle = (
        2.0
        * math.pi
        * float(index)
        / float(n)
    )

    return rg.Transform.Rotation(
        angle,
        circle.Normal,
        circle.Center
    )



def geometry_bbox(geos):
    """
    Combined world-axis-aligned bounding box for a geometry list.
    Returns None if no valid geometry is present.
    """
    bbox = None

    for g in geos:
        if g is None:
            continue

        try:
            bb = g.GetBoundingBox(True)
        except:
            continue

        if not bb.IsValid:
            continue

        if bbox is None:
            bbox = rg.BoundingBox(
                bb.Min,
                bb.Max
            )
        else:
            bbox.Union(
                bb
            )

    return bbox


def group_to_mesh(geos):
    """
    Convert Brep / Mesh / SubD items into one lightweight mesh
    for the three key-state interference checks.
    """
    result = rg.Mesh()

    for geo in geos:
        if geo is None:
            continue

        if isinstance(geo, rg.Mesh):
            result.Append(
                geo.DuplicateMesh()
            )
            continue

        if isinstance(geo, rg.SubD):
            try:
                m = rg.Mesh.CreateFromSubD(
                    geo,
                    1
                )
                if m is not None:
                    result.Append(m)
                    continue
            except:
                pass

        brep = rg.Brep.TryConvertBrep(
            geo
        )

        if brep is None:
            continue

        pieces = rg.Mesh.CreateFromBrep(
            brep,
            rg.MeshingParameters.FastRenderMesh
        )

        if pieces is None:
            continue

        for m in pieces:
            if (
                m is not None
                and m.IsValid
                and m.Faces.Count > 0
            ):
                result.Append(m)

    if result.Faces.Count == 0:
        return None

    result.Normals.ComputeNormals()
    result.Compact()

    return result


# 5. CURRENT-STATE COLLISION HELPERS
# ------------------------------------------------------------

def bbox_overlap(
    a,
    b,
    tol
):
    return not (
        a.Max.X
        < b.Min.X - tol

        or

        b.Max.X
        < a.Min.X - tol

        or

        a.Max.Y
        < b.Min.Y - tol

        or

        b.Max.Y
        < a.Min.Y - tol

        or

        a.Max.Z
        < b.Min.Z - tol

        or

        b.Max.Z
        < a.Min.Z - tol
    )


def mesh_collision(
    ma,
    mb,
    doc_tol
):
    if (
        ma is None
        or
        mb is None
    ):
        return False

    ba = ma.GetBoundingBox(
        True
    )

    bb = mb.GetBoundingBox(
        True
    )

    if not bbox_overlap(
        ba,
        bb,
        doc_tol
    ):
        return False

    mesh_tol = max(
        1e-7,
        doc_tol * 0.001
    )

    result = Intersection.MeshMeshAccurate(
        ma,
        mb,
        mesh_tol
    )

    return (
        result is not None
        and
        len(result) > 0
    )


def near_key_state(theta):
    for key in CHECK_STATES:
        if abs(
            theta - key
        ) <= CHECK_ANGLE_TOL:
            return True

    return False



# ------------------------------------------------------------
# 5B. ASSEMBLY ALIGNMENT + UPPER LIMIT SEARCH
# ------------------------------------------------------------

def point_axis_distance(pt, axis_origin, axis_direction):
    d = rg.Vector3d(axis_direction)
    if d.IsTiny():
        return float("nan")
    d.Unitize()
    v = rg.Vector3d(pt - axis_origin)
    axial = dot(v, d)
    radial = v - d * axial
    return radial.Length


def upper_adjacent_collision_for_travel(
    test_travel_magnitude,
    input_travel_sign,
    upper_master,
    upper_ring,
    upper_guide,
    theta_test,
    axis_normal,
    tol
):
    sign = -1.0 if input_travel_sign < 0.0 else 1.0
    signed_travel = sign * abs(test_travel_magnitude)

    drv = guide_driven_transform(
        upper_master,
        upper_ring,
        upper_guide,
        "UpperRing",
        "UpperGuide",
        theta_test,
        signed_travel,
        axis_normal,
        tol
    )

    g0 = []
    for g in upper_master:
        dup = duplicate_geo(g)
        dup.Transform(drv["xform"])
        g0.append(dup)

    a1 = circle_array_transform(
        drv["circle"],
        1,
        N
    )

    g1 = []
    for g in g0:
        dup = duplicate_geo(g)
        dup.Transform(a1)
        g1.append(dup)

    m0 = group_to_mesh(g0)
    m1 = group_to_mesh(g1)

    return mesh_collision(
        m0,
        m1,
        tol
    )


def search_upper_clear_limit(
    current_upper_travel,
    upper_master,
    upper_ring,
    upper_guide,
    axis_normal,
    tol
):
    max_mag = abs(float(current_upper_travel))

    if max_mag <= 1e-9:
        return {
            "status": "ZERO_INPUT",
            "last_clear": 0.0,
            "first_collision": None,
            "midpoint": 0.0,
            "design_candidate": 0.0
        }

    input_sign = -1.0 if current_upper_travel < 0.0 else 1.0

    if upper_adjacent_collision_for_travel(
        0.0,
        input_sign,
        upper_master,
        upper_ring,
        upper_guide,
        THETA_OPEN,
        axis_normal,
        tol
    ):
        return {
            "status": "COLLISION_AT_ZERO",
            "last_clear": None,
            "first_collision": 0.0,
            "midpoint": None,
            "design_candidate": None
        }

    coarse_step = 0.25
    last_clear = 0.0
    first_collision = None

    x = coarse_step
    while x < max_mag - 1e-12:
        coll = upper_adjacent_collision_for_travel(
            x,
            input_sign,
            upper_master,
            upper_ring,
            upper_guide,
            THETA_OPEN,
            axis_normal,
            tol
        )
        if coll:
            first_collision = x
            break
        last_clear = x
        x += coarse_step

    if first_collision is None:
        coll_max = upper_adjacent_collision_for_travel(
            max_mag,
            input_sign,
            upper_master,
            upper_ring,
            upper_guide,
            THETA_OPEN,
            axis_normal,
            tol
        )
        if not coll_max:
            return {
                "status": "INPUT_ALL_CLEAR",
                "last_clear": max_mag,
                "first_collision": None,
                "midpoint": None,
                "design_candidate": max(0.0, max_mag - 0.5)
            }
        first_collision = max_mag

    lo = last_clear
    hi = first_collision

    for _ in range(8):
        mid = 0.5 * (lo + hi)
        coll = upper_adjacent_collision_for_travel(
            mid,
            input_sign,
            upper_master,
            upper_ring,
            upper_guide,
            THETA_OPEN,
            axis_normal,
            tol
        )
        if coll:
            hi = mid
        else:
            lo = mid

    midpoint = 0.5 * (lo + hi)

    return {
        "status": "BRACKETED",
        "last_clear": lo,
        "first_collision": hi,
        "midpoint": midpoint,
        "design_candidate": max(0.0, lo - 0.5)
    }



# ------------------------------------------------------------
# 5C. LIGHT GEO + NORMALIZED OPTICAL PROXY
# ------------------------------------------------------------

def area_centroid(geo):
    """
    Returns area centroid for Brep / Surface / Mesh-like geometry.
    """

    if geo is None:
        return None

    try:
        amp = rg.AreaMassProperties.Compute(
            geo
        )

        if amp is not None:
            c = amp.Centroid
            amp.Dispose()
            return c

    except:
        pass

    try:
        bb = geo.GetBoundingBox(
            True
        )

        if bb.IsValid:
            return bb.Center

    except:
        pass

    return None


def planar_geo_normal(
    geo,
    up_axis,
    tol
):
    """
    Extract a stable normal from an extracted planar emitter face.

    The sign is automatically oriented toward +up_axis because the
    HoberGlow emitters are intended to fire upward toward the canopy.
    """

    plane = None

    if isinstance(
        geo,
        rg.Brep
    ):

        if geo.Faces.Count < 1:
            return None

        face = geo.Faces[0]

        try:
            res = face.TryGetPlane(
                tol
            )

            if isinstance(
                res,
                tuple
            ):

                if (
                    len(res) >= 2
                    and
                    res[0]
                ):
                    plane = res[1]

            elif isinstance(
                res,
                rg.Plane
            ):
                plane = res

        except:
            plane = None

    elif isinstance(
        geo,
        rg.Surface
    ):

        try:
            res = geo.TryGetPlane(
                tol
            )

            if isinstance(
                res,
                tuple
            ):

                if (
                    len(res) >= 2
                    and
                    res[0]
                ):
                    plane = res[1]

            elif isinstance(
                res,
                rg.Plane
            ):
                plane = res

        except:
            plane = None


    if plane is None:

        try:
            mesh = group_to_mesh(
                [geo]
            )

            if (
                mesh is not None
                and
                mesh.Faces.Count > 0
            ):

                mesh.Normals.ComputeNormals()

                n = rg.Vector3d(
                    0.0,
                    0.0,
                    0.0
                )

                for i in range(
                    mesh.Normals.Count
                ):
                    n += rg.Vector3d(
                        mesh.Normals[i]
                    )

                if not n.IsTiny():
                    n.Unitize()
                    plane = rg.Plane(
                        area_centroid(geo),
                        n
                    )

        except:
            pass


    if plane is None:
        return None


    n = rg.Vector3d(
        plane.Normal
    )

    if n.IsTiny():
        return None

    n.Unitize()


    up = rg.Vector3d(
        up_axis
    )

    if up.IsTiny():
        up = rg.Vector3d.ZAxis
    else:
        up.Unitize()


    if dot(
        n,
        up
    ) < 0.0:
        n.Reverse()

    return n


def mesh_point_distance(
    mesh,
    pt
):
    if mesh is None:
        return float(
            "inf"
        )

    try:
        q = mesh.ClosestPoint(
            pt
        )

        if (
            q is None
            or
            not q.IsValid
        ):
            return float(
                "inf"
            )

        return pt.DistanceTo(
            q
        )

    except:
        return float(
            "inf"
        )


def classify_light_parent(
    light_geo,
    source_A_mesh,
    source_B_mesh
):
    """
    Automatically classify each extracted emitter face as belonging
    to master rigid body A or B by closest source-body distance.
    """

    c = area_centroid(
        light_geo
    )

    if c is None:
        raise ValueError(
            "Could not compute LightGeo centroid."
        )

    dA = mesh_point_distance(
        source_A_mesh,
        c
    )

    dB = mesh_point_distance(
        source_B_mesh,
        c
    )

    parent = (
        "A"
        if dA <= dB
        else
        "B"
    )

    return {
        "parent": parent,
        "centroid": c,
        "dA": dA,
        "dB": dB
    }


def build_main_xforms_for_theta(
    theta_value,
    assembly_center,
    datum_x,
    datum_y,
    source_A,
    source_B,
    LA,
    LB,
    delta,
    N
):
    """
    Returns the exact same rigid-body transforms used by the main
    A/B mechanism, but without duplicating the full rigid geometry.
    """

    state = solve_main_state(
        theta_value,
        LA,
        LB,
        delta,
        N
    )

    xforms = {
        "A": [],
        "B": []
    }

    for bar in state[
        "bars"
    ]:

        ox, oy = bar[
            "origin"
        ]

        frame = target_frame_in_datum(
            assembly_center,
            datum_x,
            datum_y,
            ox,
            oy,
            bar[
                "angle"
            ]
        )

        if bar[
            "kind"
        ] == "A":

            xf = rg.Transform.PlaneToPlane(
                source_A,
                frame
            )

            xforms["A"].append(
                xf
            )

        else:

            xf = rg.Transform.PlaneToPlane(
                source_B,
                frame
            )

            xforms["B"].append(
                xf
            )

    return xforms


def transform_lights_for_theta(
    light_sources,
    light_parents,
    theta_value,
    assembly_center,
    datum_x,
    datum_y,
    source_A,
    source_B,
    LA,
    LB,
    delta,
    N
):
    xforms = build_main_xforms_for_theta(
        theta_value,
        assembly_center,
        datum_x,
        datum_y,
        source_A,
        source_B,
        LA,
        LB,
        delta,
        N
    )

    moved = []

    for i, geo in enumerate(
        light_sources
    ):

        parent = light_parents[i][
            "parent"
        ]

        for xf in xforms[
            parent
        ]:

            dup = duplicate_geo(
                geo
            )

            if dup is None:
                continue

            if not dup.Transform(
                xf
            ):
                continue

            moved.append(
                dup
            )

    return moved


def build_canopy_for_theta(
    theta_value,
    upper_master,
    lower_master,
    upper_ring,
    upper_guide,
    lower_ring,
    lower_guide,
    upper_max_travel,
    lower_max_travel,
    axis_normal,
    tol
):
    """
    Lightweight canopy reconstruction for optical-state evaluation.
    """

    u_drv = guide_driven_transform(
        upper_master,
        upper_ring,
        upper_guide,
        "UpperRing",
        "UpperGuide",
        theta_value,
        upper_max_travel,
        axis_normal,
        tol
    )

    l_drv = guide_driven_transform(
        lower_master,
        lower_ring,
        lower_guide,
        "LowerRing",
        "LowerGuide",
        theta_value,
        lower_max_travel,
        axis_normal,
        tol
    )

    geos = []

    for i in range(
        N
    ):

        u_array = circle_array_transform(
            u_drv[
                "circle"
            ],
            i,
            N
        )

        l_array = circle_array_transform(
            l_drv[
                "circle"
            ],
            i,
            N
        )

        for g in upper_master:

            dup = duplicate_geo(
                g
            )

            dup.Transform(
                u_drv[
                    "xform"
                ]
            )

            dup.Transform(
                u_array
            )

            geos.append(
                dup
            )

        for g in lower_master:

            dup = duplicate_geo(
                g
            )

            dup.Transform(
                l_drv[
                    "xform"
                ]
            )

            dup.Transform(
                l_array
            )

            geos.append(
                dup
            )

    return geos


def orthonormal_basis_from_axis(
    axis
):
    z = rg.Vector3d(
        axis
    )

    if z.IsTiny():
        z = rg.Vector3d.ZAxis
    else:
        z.Unitize()

    helper = rg.Vector3d.XAxis

    if abs(
        dot(
            helper,
            z
        )
    ) > 0.90:
        helper = rg.Vector3d.YAxis

    x = rg.Vector3d.CrossProduct(
        helper,
        z
    )

    x.Unitize()

    y = rg.Vector3d.CrossProduct(
        z,
        x
    )

    y.Unitize()

    return x, y, z


def cone_directions(
    axis,
    half_angle_deg
):
    """
    Deterministic normalized cone sampling.
    """

    x, y, z = orthonormal_basis_from_axis(
        axis
    )

    half = math.radians(
        half_angle_deg
    )

    dirs = []

    for radial_fraction, count in LIGHT_RAY_RING_COUNTS:

        a = (
            half
            * radial_fraction
        )

        if count == 1:

            dirs.append(
                rg.Vector3d(
                    z
                )
            )

            continue

        for j in range(
            count
        ):

            phi = (
                2.0
                * math.pi
                * float(j)
                / float(count)
            )

            radial = (
                rg.Vector3d(x)
                * math.cos(phi)
                +
                rg.Vector3d(y)
                * math.sin(phi)
            )

            d = (
                rg.Vector3d(z)
                * math.cos(a)
                +
                radial
                * math.sin(a)
            )

            d.Unitize()

            dirs.append(
                d
            )

    return dirs


def reflect_vector(
    incoming,
    normal
):
    I = rg.Vector3d(
        incoming
    )

    Nn = rg.Vector3d(
        normal
    )

    I.Unitize()
    Nn.Unitize()

    R = (
        I
        -
        Nn
        * (
            2.0
            * dot(
                I,
                Nn
            )
        )
    )

    if not R.IsTiny():
        R.Unitize()

    return R


def mesh_hit_normal(
    mesh,
    hit_point,
    tol
):
    """
    Uses ClosestMeshPoint + Mesh.NormalAt at the ray hit.
    """

    max_dist = max(
        tol * 100.0,
        1e-4
    )

    try:
        mp = mesh.ClosestMeshPoint(
            hit_point,
            max_dist
        )

        if mp is None:
            return None

        n = mesh.NormalAt(
            mp
        )

        if n.IsTiny():
            return None

        n.Unitize()

        return n

    except:
        return None


def ray_plane_hit(
    origin,
    direction,
    plane_origin,
    plane_normal
):
    d = rg.Vector3d(
        direction
    )

    n = rg.Vector3d(
        plane_normal
    )

    denom = dot(
        d,
        n
    )

    if abs(
        denom
    ) < 1e-10:
        return None

    t = dot(
        plane_origin - origin,
        n
    ) / denom

    if t <= 0.0:
        return None

    return (
        origin
        + d * t
    )


def radial_distance_on_plane(
    pt,
    centre,
    plane_normal
):
    n = rg.Vector3d(
        plane_normal
    )

    n.Unitize()

    v = rg.Vector3d(
        pt - centre
    )

    axial = dot(
        v,
        n
    )

    planar = (
        v
        - n * axial
    )

    return planar.Length


def optical_state_analysis(
    state_name,
    theta_value,
    moved_lights,
    canopy_geo,
    assembly_center,
    up_axis,
    floor_drop,
    tol,
    preview
):
    """
    One-bounce geometric optical proxy.

    Pipeline:
      emitter centroid + upward normal
      -> cone rays
      -> first canopy mesh hit
      -> local mesh normal
      -> ideal geometric reflection
      -> virtual work plane

    This is NOT lux / IES / photometric simulation.
    """

    canopy_mesh = group_to_mesh(
        canopy_geo
    )

    if canopy_mesh is None:
        raise ValueError(
            "Could not mesh canopy for optical analysis."
        )

    up = rg.Vector3d(
        up_axis
    )

    up.Unitize()

    floor_origin = (
        assembly_center
        - up * floor_drop
    )

    total_rays = 0
    canopy_hits = 0
    downward_reflections = 0
    ground_hits = []

    preview_geo = []

    emitter_centres = []


    for light_index, light in enumerate(
        moved_lights
    ):

        c = area_centroid(
            light
        )

        n = planar_geo_normal(
            light,
            up,
            tol
        )

        if (
            c is None
            or
            n is None
        ):
            continue

        emitter_centres.append(
            c
        )

        directions = cone_directions(
            n,
            LIGHT_CONE_HALF_ANGLE_DEG
        )

        start = (
            c
            + n * max(
                tol * 20.0,
                1e-4
            )
        )

        for local_index, d in enumerate(
            directions
        ):

            ray_index = total_rays
            total_rays += 1

            ray = rg.Ray3d(
                start,
                d
            )

            t = Intersection.MeshRay(
                canopy_mesh,
                ray
            )

            if t < 0.0:
                continue

            canopy_hits += 1

            hit = (
                start
                + d * t
            )

            hit_n = mesh_hit_normal(
                canopy_mesh,
                hit,
                tol
            )

            if hit_n is None:
                continue

            r = reflect_vector(
                d,
                hit_n
            )

            if r.IsTiny():
                continue

            if dot(
                r,
                up
            ) < 0.0:

                downward_reflections += 1

                floor_hit = ray_plane_hit(
                    hit
                    + r * max(
                        tol * 20.0,
                        1e-4
                    ),
                    r,
                    floor_origin,
                    up
                )

                if floor_hit is not None:

                    ground_hits.append(
                        floor_hit
                    )

                    if (
                        preview
                        and
                        ray_index
                        % OPTICAL_PREVIEW_STRIDE
                        == 0
                    ):

                        preview_geo.append(
                            rg.LineCurve(
                                start,
                                hit
                            )
                        )

                        preview_geo.append(
                            rg.LineCurve(
                                hit,
                                floor_hit
                            )
                        )


    capture_ratio = (
        0.0
        if total_rays == 0
        else
        float(
            canopy_hits
        ) / float(
            total_rays
        )
    )

    downward_ratio = (
        0.0
        if canopy_hits == 0
        else
        float(
            downward_reflections
        ) / float(
            canopy_hits
        )
    )

    floor_ratio = (
        0.0
        if total_rays == 0
        else
        float(
            len(
                ground_hits
            )
        ) / float(
            total_rays
        )
    )


    radii = [
        radial_distance_on_plane(
            p,
            floor_origin,
            up
        )
        for p in ground_hits
    ]


    if len(
        radii
    ) > 0:

        r50 = percentile(
            radii,
            0.50
        )

        r80 = percentile(
            radii,
            0.80
        )

        mean_r = (
            sum(
                radii
            ) / float(
                len(
                    radii
                )
            )
        )

        var_r = (
            sum(
                (
                    rr - mean_r
                ) ** 2
                for rr in radii
            )
            / float(
                len(
                    radii
                )
            )
        )

        sd_r = math.sqrt(
            var_r
        )

        D50 = (
            2.0 * r50
        )

        D80 = (
            2.0 * r80
        )

    else:

        D50 = None
        D80 = None
        mean_r = None
        sd_r = None


    if preview:

        for light in moved_lights:
            preview_geo.append(
                duplicate_geo(
                    light
                )
            )

        if D50 is not None:

            floor_plane = rg.Plane(
                floor_origin,
                up
            )

            preview_geo.append(
                rg.Circle(
                    floor_plane,
                    0.5 * D50
                ).ToNurbsCurve()
            )

        if D80 is not None:

            floor_plane = rg.Plane(
                floor_origin,
                up
            )

            preview_geo.append(
                rg.Circle(
                    floor_plane,
                    0.5 * D80
                ).ToNurbsCurve()
            )


    return {
        "name": state_name,
        "theta": theta_value,
        "emitters": len(
            emitter_centres
        ),
        "total_rays": total_rays,
        "canopy_hits": canopy_hits,
        "downward": downward_reflections,
        "ground_hits": len(
            ground_hits
        ),
        "capture_ratio": capture_ratio,
        "downward_ratio": downward_ratio,
        "floor_ratio": floor_ratio,
        "D50": D50,
        "D80": D80,
        "mean_radius": mean_r,
        "sd_radius": sd_r,
        "floor_drop": floor_drop,
        "preview_geo": preview_geo
    }


# ------------------------------------------------------------
# 6. MAIN
# ------------------------------------------------------------

try:

    try:
        doc_tol = (
            Rhino.RhinoDoc
            .ActiveDoc
            .ModelAbsoluteTolerance
        )
    except:
        doc_tol = 0.001

    tol = max(
        doc_tol,
        1e-6
    )


    # --------------------------------------------------------
    # LIVE THETA
    # --------------------------------------------------------
    #
    # Reuse old ThetaMin input so the user does not have to
    # rebuild the component shell.
    #
    theta_deg = (
        THETA_REF
        if Theta is None
        else float(Theta)
    )

    theta_deg = clamp(
        theta_deg,
        1.0,
        134.9
    )

    CheckTheta_list = [
        theta_deg
    ]


    # --------------------------------------------------------
    # MAIN A/B RIGID MECHANISM
    # --------------------------------------------------------

    # --------------------------------------------------------
    # TREE-SAFE INPUT DIAGNOSTICS
    # --------------------------------------------------------
    A_tree_meta = tree_input_meta(
        A_geo
    )

    B_tree_meta = tree_input_meta(
        B_geo
    )

    UpperPetal_tree_meta = tree_input_meta(
        UpperPetal
    )

    LowerPetal_tree_meta = tree_input_meta(
        LowerPetal
    )

    LightGeo_tree_meta = tree_input_meta(
        LightGeo
    )


    A_parts = as_geo_list(
        A_geo
    )

    B_parts = as_geo_list(
        B_geo
    )

    if len(A_parts) == 0:
        raise ValueError(
            "A_geo is empty."
        )

    if len(B_parts) == 0:
        raise ValueError(
            "B_geo is empty."
        )


    # --------------------------------------------------------
    # LIGHT SOURCE INPUT
    # --------------------------------------------------------
    light_sources = as_geo_list(
        LightGeo
    )

    if len(
        light_sources
    ) == 0:
        raise ValueError(
            "LightGeo is empty. Connect only the extracted master "
            "emitter face(s), not the already-arrayed final lights."
        )


    LC = as_line(
        C_axis,
        "C_axis",
        tol
    )

    LA1line = as_line(
        A_axis1,
        "A_axis1",
        tol
    )

    LA2line = as_line(
        A_axis2,
        "A_axis2",
        tol
    )

    LB1line = as_line(
        B_axis1,
        "B_axis1",
        tol
    )

    LB2line = as_line(
        B_axis2,
        "B_axis2",
        tol
    )


    C = LC.PointAt(
        0.5
    )

    Z = rg.Vector3d(
        LC.Direction
    )

    if Z.IsTiny():
        raise ValueError(
            "C_axis has zero direction."
        )

    Z.Unitize()


    # --------------------------------------------------------
    # GLOBAL ASSEMBLY AXIS FROM THE TWO REAL CANOPY RINGS
    # --------------------------------------------------------
    #
    # C_axis belongs to one local hinge of the calibrated
    # scissors unit; it is NOT the global centre axis.
    #
    # The two authored solid canopy rings are the most reliable
    # global datum for the complete luminaire.
    #
    upper_ring_global = ring_solid_center_circle(
        UpperRing,
        Z,
        "UpperRing",
        tol
    )

    lower_ring_global = ring_solid_center_circle(
        LowerRing,
        Z,
        "LowerRing",
        tol
    )

    upper_global_center = upper_ring_global[
        "circle"
    ].Center

    lower_global_center = lower_ring_global[
        "circle"
    ].Center

    # Midpoint between both authored ring centres.
    # The axis direction remains the calibrated hinge-axis direction Z.
    canopy_axis_origin = rg.Point3d(
        0.5 * (
            upper_global_center.X
            + lower_global_center.X
        ),
        0.5 * (
            upper_global_center.Y
            + lower_global_center.Y
        ),
        0.5 * (
            upper_global_center.Z
            + lower_global_center.Z
        )
    )


    A1 = infinite_line_plane_point(
        LA1line,
        C,
        Z
    )

    A2 = infinite_line_plane_point(
        LA2line,
        C,
        Z
    )

    B1 = infinite_line_plane_point(
        LB1line,
        C,
        Z
    )

    B2 = infinite_line_plane_point(
        LB2line,
        C,
        Z
    )


    X = rg.Vector3d(
        A1 - C
    )

    if X.IsTiny():
        X = rg.Vector3d(
            B1 - C
        )

    X.Unitize()


    Y = rg.Vector3d.CrossProduct(
        Z,
        X
    )

    if Y.IsTiny():
        raise ValueError(
            "Could not construct main datum frame."
        )

    Y.Unitize()


    delta = (
        2.0
        * math.pi
        / float(N)
    )


    fitA = fit_bar(
        C,
        A1,
        A2,
        X,
        Y,
        delta
    )

    fitB = fit_bar(
        C,
        B1,
        B2,
        X,
        Y,
        delta
    )


    LA = fitA[
        "L"
    ]

    LB = fitB[
        "L"
    ]


    source_A = source_frame_from_fit(
        C,
        X,
        Y,
        fitA
    )

    source_B = source_frame_from_fit(
        C,
        X,
        Y,
        fitB
    )


    # --------------------------------------------------------
    # AUTO CLASSIFY EACH MASTER LIGHT AS A-PARENT OR B-PARENT
    # --------------------------------------------------------
    source_A_mesh_for_light = group_to_mesh(
        A_parts
    )

    source_B_mesh_for_light = group_to_mesh(
        B_parts
    )

    if (
        source_A_mesh_for_light is None
        or
        source_B_mesh_for_light is None
    ):
        raise ValueError(
            "Could not mesh A_geo/B_geo for automatic LightGeo parent classification."
        )

    light_parent_info = []

    for light in light_sources:

        light_parent_info.append(
            classify_light_parent(
                light,
                source_A_mesh_for_light,
                source_B_mesh_for_light
            )
        )


    betaA_deg = math.degrees(
        fitA["beta"]
    )

    betaB_deg = math.degrees(
        fitB["beta"]
    )

    raw_ref = (
        betaB_deg
        - betaA_deg
    ) % 360.0

    theta_ref = min(
        raw_ref,
        360.0 - raw_ref
    )


    # Reconstruct the authored full-ring centre.
    reference_state = solve_main_state(
        theta_ref,
        LA,
        LB,
        delta,
        N
    )

    ref_c0_x, ref_c0_y = (
        reference_state["bars"][0]["origin"]
    )

    raw_assembly_center = (
        C
        - rg.Vector3d(X) * ref_c0_x
        - rg.Vector3d(Y) * ref_c0_y
    )


    # --------------------------------------------------------
    # FORCE MAIN MECHANISM ONTO THE AUTHORED CANOPY AXIS
    # --------------------------------------------------------
    #
    # Preserve the axial position derived from the original
    # source mechanism, but replace the unreliable radial centre
    # with the real canopy centre axis.
    #
    raw_from_canopy_axis = rg.Vector3d(
        raw_assembly_center
        - canopy_axis_origin
    )

    axial_coordinate = dot(
        raw_from_canopy_axis,
        Z
    )

    assembly_center = (
        canopy_axis_origin
        + rg.Vector3d(Z) * axial_coordinate
    )

    # --------------------------------------------------------
    # SHARED GLOBAL DATUM OUTPUT FOR STRUCTURAL MODEL
    # --------------------------------------------------------
    # Do not reconstruct the full-ring centre again in the FEA code.
    # This is the same corrected centre used by the mechanism/optical model.
    AssemblyCenter = rg.Point3d(assembly_center)

    # Exact in-plane datum used by the main mechanism itself.
    # This exports BOTH translation and angular phase/orientation.
    # FEA must reuse this plane instead of rebuilding X/Y independently.
    AssemblyPlane = rg.Plane(
        assembly_center,
        rg.Vector3d(X),
        rg.Vector3d(Y)
    )

    if not AssemblyPlane.IsValid:
        raise ValueError(
            "Could not create shared AssemblyPlane."
        )

    axis_half_length = max(
        upper_ring_global["r_outer"],
        lower_ring_global["r_outer"],
        1.0
    )

    AssemblyAxis = rg.Line(
        assembly_center - rg.Vector3d(Z) * axis_half_length,
        assembly_center + rg.Vector3d(Z) * axis_half_length
    )


    main_state = solve_main_state(
        theta_deg,
        LA,
        LB,
        delta,
        N
    )


    main_A = []
    main_B = []

    # Structural joint points exported from the exact same rigid transforms.
    FEA_AJoints = []
    FEA_BJoints = []
    FEA_PinAxis = rg.Vector3d(Z)
    FEA_Theta = float(theta_deg)


    for bar in main_state[
        "bars"
    ]:
        ox, oy = bar[
            "origin"
        ]

        frame = target_frame_in_datum(
            assembly_center,
            X,
            Y,
            ox,
            oy,
            bar[
                "angle"
            ]
        )

        if bar[
            "kind"
        ] == "A":

            xf = rg.Transform.PlaneToPlane(
                source_A,
                frame
            )

            moved = transform_group(
                A_parts,
                xf
            )

            main_A.extend(
                moved
            )

            # EXACT A physical-member hinge points in the moved geometry.
            # Use the authored source hinge-axis intersections and the SAME
            # transform as the visible A geometry.
            a_p1 = rg.Point3d(A1)
            a_pc = rg.Point3d(C)
            a_p2 = rg.Point3d(A2)

            a_p1.Transform(xf)
            a_pc.Transform(xf)
            a_p2.Transform(xf)

            FEA_AJoints.extend([
                a_p1,
                a_pc,
                a_p2
            ])

        else:

            xf = rg.Transform.PlaneToPlane(
                source_B,
                frame
            )

            moved = transform_group(
                B_parts,
                xf
            )

            main_B.extend(
                moved
            )

            # EXACT B physical-member hinge points in the moved geometry.
            b_p1 = rg.Point3d(B1)
            b_pc = rg.Point3d(C)
            b_p2 = rg.Point3d(B2)

            b_p1.Transform(xf)
            b_pc.Transform(xf)
            b_p2.Transform(xf)

            FEA_BJoints.extend([
                b_p1,
                b_pc,
                b_p2
            ])


    # Hard audit: 8 physical A members + 8 physical B members,
    # each represented by [End1, C, End2].
    if len(FEA_AJoints) != 24:
        raise ValueError(
            "FEA_AJoints export failed: expected 24 points, got {}."
            .format(len(FEA_AJoints))
        )

    if len(FEA_BJoints) != 24:
        raise ValueError(
            "FEA_BJoints export failed: expected 24 points, got {}."
            .format(len(FEA_BJoints))
        )


    main_geo = (
        main_A
        +
        main_B
    )



    # --------------------------------------------------------
    # TWO-LAYER CANOPY — BLACK GUIDE ON CIRCULAR RING
    # --------------------------------------------------------

    upper_master = as_geo_list(
        UpperPetal
    )

    lower_master = as_geo_list(
        LowerPetal
    )

    if len(upper_master) == 0:
        raise ValueError(
            "UpperPetal is empty."
        )

    if len(lower_master) == 0:
        raise ValueError(
            "LowerPetal is empty."
        )

    # Reuse the old ThetaMax / Step sockets, but rename them:
    #
    #   ThetaMax -> UpperTravel
    #   Step     -> LowerTravel
    #
    upper_max_travel = (
        DEFAULT_UPPER_TRAVEL
        if UpperTravel is None
        else float(
            UpperTravel
        )
    )

    lower_max_travel = (
        DEFAULT_LOWER_TRAVEL
        if LowerTravel is None
        else float(
            LowerTravel
        )
    )


    upper_driver = guide_driven_transform(
        upper_master,
        UpperRing,
        UpperGuide,
        "UpperRing",
        "UpperGuide",
        theta_deg,
        upper_max_travel,
        Z,
        tol
    )

    lower_driver = guide_driven_transform(
        lower_master,
        LowerRing,
        LowerGuide,
        "LowerRing",
        "LowerGuide",
        theta_deg,
        lower_max_travel,
        Z,
        tol
    )


    MinBBoxGap_list = [
        upper_driver[
            "centrelineDistance"
        ],
        lower_driver[
            "centrelineDistance"
        ]
    ]


    Zone_list = [
        upper_driver[
            "flip"
        ],
        lower_driver[
            "flip"
        ]
    ]


    upper_all = []
    lower_all = []

    upper_meshes = []
    lower_meshes = []

    moved_guides = []


    for i in range(
        N
    ):
        u_array = circle_array_transform(
            upper_driver[
                "circle"
            ],
            i,
            N
        )

        l_array = circle_array_transform(
            lower_driver[
                "circle"
            ],
            i,
            N
        )


        upper_i = []

        for g in upper_master:
            dup = duplicate_geo(
                g
            )

            dup.Transform(
                upper_driver[
                    "xform"
                ]
            )

            dup.Transform(
                u_array
            )

            upper_i.append(
                dup
            )


        lower_i = []

        for g in lower_master:
            dup = duplicate_geo(
                g
            )

            dup.Transform(
                lower_driver[
                    "xform"
                ]
            )

            dup.Transform(
                l_array
            )

            lower_i.append(
                dup
            )


        upper_all.extend(
            upper_i
        )

        lower_all.extend(
            lower_i
        )


        # Debug guides: these are the black reference lines
        # after the current ring travel.
        ug = upper_driver[
            "targetGuide"
        ].DuplicateCurve()

        lg = lower_driver[
            "targetGuide"
        ].DuplicateCurve()

        ug.Transform(
            u_array
        )

        lg.Transform(
            l_array
        )

        moved_guides.extend([
            ug,
            lg
        ])


        if near_key_state(
            theta_deg
        ):
            upper_meshes.append(
                group_to_mesh(
                    upper_i
                )
            )

            lower_meshes.append(
                group_to_mesh(
                    lower_i
                )
            )


    canopy_geo = (
        upper_all
        +
        lower_all
    )


    # Unified assembly-axis diagnostics.
    upper_circle_center = upper_driver["circle"].Center
    lower_circle_center = lower_driver["circle"].Center

    raw_upper_axis_offset = point_axis_distance(
        upper_circle_center,
        raw_assembly_center,
        Z
    )

    raw_lower_axis_offset = point_axis_distance(
        lower_circle_center,
        raw_assembly_center,
        Z
    )

    upper_axis_offset = point_axis_distance(
        upper_circle_center,
        assembly_center,
        Z
    )

    lower_axis_offset = point_axis_distance(
        lower_circle_center,
        assembly_center,
        Z
    )

    main_to_upper_axial = dot(
        upper_circle_center - assembly_center,
        Z
    )

    main_to_lower_axial = dot(
        lower_circle_center - assembly_center,
        Z
    )


    # Automatic Upper adjacent-petal limit search at OPEN only.
    upper_limit_result = None

    if abs(theta_deg - THETA_OPEN) <= CHECK_ANGLE_TOL:
        upper_limit_result = search_upper_clear_limit(
            upper_max_travel,
            upper_master,
            UpperRing,
            UpperGuide,
            Z,
            tol
        )


    # Reuse Rows for the 16 moving black guide lines.
    Rows = moved_guides


    # --------------------------------------------------------
    # CURRENT-STATE INTERFERENCE
    # --------------------------------------------------------

    collision_details = []


    if near_key_state(
        theta_deg
    ):

        # Upper same-layer adjacent.
        for i in range(
            N
        ):
            j = (
                i + 1
            ) % N

            if mesh_collision(
                upper_meshes[i],
                upper_meshes[j],
                tol
            ):
                collision_details.append(
                    "UPPER {}-{}"
                    .format(
                        i,
                        j
                    )
                )


        # Lower same-layer adjacent.
        for i in range(
            N
        ):
            j = (
                i + 1
            ) % N

            if mesh_collision(
                lower_meshes[i],
                lower_meshes[j],
                tol
            ):
                collision_details.append(
                    "LOWER {}-{}"
                    .format(
                        i,
                        j
                    )
                )


        # Cross-layer collision.
        for i in range(
            N
        ):
            for j in range(
                N
            ):
                if mesh_collision(
                    upper_meshes[i],
                    lower_meshes[j],
                    tol
                ):
                    collision_details.append(
                        "UPPER{}-LOWER{}"
                        .format(
                            i,
                            j
                        )
                    )


        # Canopy vs current main A/B ring.
        main_mesh = group_to_mesh(
            main_geo
        )

        if main_mesh is not None:

            for i, m in enumerate(
                upper_meshes
            ):
                if mesh_collision(
                    m,
                    main_mesh,
                    tol
                ):
                    collision_details.append(
                        "UPPER{}-MAIN"
                        .format(i)
                    )

            for i, m in enumerate(
                lower_meshes
            ):
                if mesh_collision(
                    m,
                    main_mesh,
                    tol
                ):
                    collision_details.append(
                        "LOWER{}-MAIN"
                        .format(i)
                    )


    OverlapPairs_list = (
        collision_details
    )


    # --------------------------------------------------------
    # COMPLETE OUTPUT
    # --------------------------------------------------------

    Result_list = (
        main_geo
        +
        canopy_geo
        +
        [
            duplicate_geo(
                UpperRing
            ),
            duplicate_geo(
                LowerRing
            )
        ]
    )


    if near_key_state(
        theta_deg
    ):
        collision_status = (
            "CLEAR"
            if len(
                collision_details
            ) == 0
            else
            "INTERFERENCE"
        )

    else:
        collision_status = (
            "LIVE PREVIEW - COLLISION CHECK SKIPPED"
        )


    ClosestPair_list = [
        collision_status,
        "Upper canopy axis offset from main axis = {:.6f}"
        .format(
            upper_axis_offset
        ),
        "Lower canopy axis offset from main axis = {:.6f}"
        .format(
            lower_axis_offset
        ),
        "Main->Upper axial spacing = {:.6f}"
        .format(
            main_to_upper_axial
        ),
        "Main->Lower axial spacing = {:.6f}"
        .format(
            main_to_lower_axial
        )
    ]


    canopy_bb = geometry_bbox(
        canopy_geo
    )

    if canopy_bb is not None:

        canopy_xy = max(
            canopy_bb.Max.X
            - canopy_bb.Min.X,
            canopy_bb.Max.Y
            - canopy_bb.Min.Y
        )

        canopy_z = (
            canopy_bb.Max.Z
            - canopy_bb.Min.Z
        )

    else:

        canopy_xy = float(
            "nan"
        )

        canopy_z = float(
            "nan"
        )


    # --------------------------------------------------------
    # CURRENT-THETA + 3-STATE NORMALIZED OPTICAL ANALYSIS
    # --------------------------------------------------------
    #
    # V23 CHANGE:
    #   OpticalPreview now follows ANY valid current Theta.
    #   OPEN / MID / CLOSED are still computed as benchmark states.
    #
    # This removes the previous key-state-only preview gate.

    source_canopy_bb = geometry_bbox(
        upper_master
        +
        lower_master
    )

    if (
        source_canopy_bb is None
        or
        not source_canopy_bb.IsValid
    ):
        raise ValueError(
            "Could not determine source canopy scale for optical work-plane."
        )

    source_canopy_diameter = max(
        source_canopy_bb.Max.X
        - source_canopy_bb.Min.X,
        source_canopy_bb.Max.Y
        - source_canopy_bb.Min.Y
    )

    optical_floor_drop = (
        source_canopy_diameter
        * OPTICAL_FLOOR_DROP_FACTOR
    )


    # --------------------------------------------------------
    # A. CURRENT THETA — ALWAYS PREVIEW + REPORT
    # --------------------------------------------------------

    current_lights = transform_lights_for_theta(
        light_sources,
        light_parent_info,
        theta_deg,
        assembly_center,
        X,
        Y,
        source_A,
        source_B,
        LA,
        LB,
        delta,
        N
    )

    current_canopy = build_canopy_for_theta(
        theta_deg,
        upper_master,
        lower_master,
        UpperRing,
        UpperGuide,
        LowerRing,
        LowerGuide,
        upper_max_travel,
        lower_max_travel,
        Z,
        tol
    )

    current_optical = optical_state_analysis(
        "CURRENT",
        theta_deg,
        current_lights,
        current_canopy,
        assembly_center,
        Z,
        optical_floor_drop,
        tol,
        True
    )

    OpticalGeo = current_optical[
        "preview_geo"
    ]


    # --------------------------------------------------------
    # B. FIXED BENCHMARK STATES — OPEN / MID / CLOSED
    # --------------------------------------------------------

    optical_results = []

    for state_name, state_theta in OPTICAL_STATES:

        # If current Theta is exactly one of the benchmark states,
        # reuse the current result instead of tracing the same rays twice.
        if abs(
            theta_deg
            - state_theta
        ) <= 1e-9:

            opt = dict(
                current_optical
            )

            opt[
                "name"
            ] = state_name

            opt[
                "theta"
            ] = state_theta

            # Keep only current-state preview geometry in OpticalGeo.
            # Benchmark metrics do not need separate preview geometry.
            opt[
                "preview_geo"
            ] = []

        else:

            state_lights = transform_lights_for_theta(
                light_sources,
                light_parent_info,
                state_theta,
                assembly_center,
                X,
                Y,
                source_A,
                source_B,
                LA,
                LB,
                delta,
                N
            )

            state_canopy = build_canopy_for_theta(
                state_theta,
                upper_master,
                lower_master,
                UpperRing,
                UpperGuide,
                LowerRing,
                LowerGuide,
                upper_max_travel,
                lower_max_travel,
                Z,
                tol
            )

            opt = optical_state_analysis(
                state_name,
                state_theta,
                state_lights,
                state_canopy,
                assembly_center,
                Z,
                optical_floor_drop,
                tol,
                False
            )

        optical_results.append(
            opt
        )


    # --------------------------------------------------------
    # C. READABLE OPTICAL REPORT
    # --------------------------------------------------------

    OpticalSummary = [
        "=== HoberGlow CURRENT + 3-STATE NORMALIZED OPTICAL PROXY ===",
        "",
        "STATUS: OK",
        "",
        "MODEL:",
        "Extracted master LightGeo -> auto A/B parent -> 8-fold rigid transform.",
        "One-bounce geometric ray reflection from canopy mesh.",
        "No IES / lumen / material BRDF / measured lux is assumed.",
        "",
        "CURRENT PREVIEW:",
        "OpticalPreview follows the live Theta at ANY valid angle.",
        "OPEN / MID / CLOSED remain fixed benchmark states for comparison.",
        "",
        "Light cone half-angle = {:.1f} deg"
        .format(
            LIGHT_CONE_HALF_ANGLE_DEG
        ),
        "Rays per emitter = {}"
        .format(
            sum(
                count
                for _, count
                in LIGHT_RAY_RING_COUNTS
            )
        ),
        "Virtual work-plane drop = {:.6f} model units"
        .format(
            optical_floor_drop
        ),
        "",
        "TREE-SAFE INPUT CHECK:",
        "A_geo        : mode={} | branches={} | raw items={} | flattened geometry={}"
        .format(
            A_tree_meta[2],
            A_tree_meta[0],
            A_tree_meta[1],
            len(
                A_parts
            )
        ),
        "B_geo        : mode={} | branches={} | raw items={} | flattened geometry={}"
        .format(
            B_tree_meta[2],
            B_tree_meta[0],
            B_tree_meta[1],
            len(
                B_parts
            )
        ),
        "UpperPetal   : mode={} | branches={} | raw items={} | flattened geometry={}"
        .format(
            UpperPetal_tree_meta[2],
            UpperPetal_tree_meta[0],
            UpperPetal_tree_meta[1],
            len(
                upper_master
            )
        ),
        "LowerPetal   : mode={} | branches={} | raw items={} | flattened geometry={}"
        .format(
            LowerPetal_tree_meta[2],
            LowerPetal_tree_meta[0],
            LowerPetal_tree_meta[1],
            len(
                lower_master
            )
        ),
        "LightGeo     : mode={} | branches={} | raw items={} | flattened geometry={}"
        .format(
            LightGeo_tree_meta[2],
            LightGeo_tree_meta[0],
            LightGeo_tree_meta[1],
            len(
                light_sources
            )
        ),
        "",
        "IMPORTANT:",
        "The five geometry inputs above should report mode=TREE.",
        "The component should produce ONE OpticalReport branch only.",
        "",
        "LIGHT SOURCE PARENT CLASSIFICATION:",
    ]


    for i, info in enumerate(
        light_parent_info
    ):

        OpticalSummary.append(
            "Light {:02d} -> {} | dA={:.6f} | dB={:.6f}"
            .format(
                i,
                info[
                    "parent"
                ],
                info[
                    "dA"
                ],
                info[
                    "dB"
                ]
            )
        )


    tree_modes = [
        A_tree_meta[2],
        B_tree_meta[2],
        UpperPetal_tree_meta[2],
        LowerPetal_tree_meta[2],
        LightGeo_tree_meta[2]
    ]

    if not all(
        m == "TREE"
        for m in tree_modes
    ):
        OpticalSummary.extend([
            "",
            "WARNING:",
            "One or more multi-geometry inputs are NOT using Tree Access.",
            "Right-click A_geo, B_geo, UpperPetal, LowerPetal and LightGeo",
            "and set Access = Tree before accepting optical metrics.",
            ""
        ])


    # --------------------------------------------------------
    # D. CURRENT THETA METRICS
    # --------------------------------------------------------

    OpticalSummary.extend([
        "",
        "================================",
        "CURRENT THETA RESULT",
        "================================",
        "",
        "CURRENT | Theta={:.3f} | emitters={} | rays={}"
        .format(
            current_optical[
                "theta"
            ],
            current_optical[
                "emitters"
            ],
            current_optical[
                "total_rays"
            ]
        ),
        "Capture={:.1f}% | Downward-after-hit={:.1f}% | Floor-hit={:.1f}%"
        .format(
            100.0
            * current_optical[
                "capture_ratio"
            ],
            100.0
            * current_optical[
                "downward_ratio"
            ],
            100.0
            * current_optical[
                "floor_ratio"
            ]
        ),
    ])

    if (
        current_optical[
            "D50"
        ] is not None
        and
        current_optical[
            "D80"
        ] is not None
    ):

        OpticalSummary.append(
            "D50={:.3f} | D80={:.3f} | MeanR={:.3f} | SdR={:.3f}"
            .format(
                current_optical[
                    "D50"
                ],
                current_optical[
                    "D80"
                ],
                current_optical[
                    "mean_radius"
                ],
                current_optical[
                    "sd_radius"
                ]
            )
        )

    else:

        OpticalSummary.append(
            "No valid downward work-plane footprint."
        )


    # --------------------------------------------------------
    # E. OPEN / MID / CLOSED BENCHMARK METRICS
    # --------------------------------------------------------

    OpticalSummary.extend([
        "",
        "================================",
        "3-STATE BENCHMARK RESULTS",
        "================================",
        "",
    ])


    for opt in optical_results:

        OpticalSummary.append(
            "{} | Theta={:.3f} | emitters={} | rays={}"
            .format(
                opt[
                    "name"
                ],
                opt[
                    "theta"
                ],
                opt[
                    "emitters"
                ],
                opt[
                    "total_rays"
                ]
            )
        )

        OpticalSummary.append(
            "Capture={:.1f}% | Downward-after-hit={:.1f}% | Floor-hit={:.1f}%"
            .format(
                100.0
                * opt[
                    "capture_ratio"
                ],
                100.0
                * opt[
                    "downward_ratio"
                ],
                100.0
                * opt[
                    "floor_ratio"
                ]
            )
        )

        if (
            opt[
                "D50"
            ] is not None
            and
            opt[
                "D80"
            ] is not None
        ):

            OpticalSummary.append(
                "D50={:.3f} | D80={:.3f} | MeanR={:.3f} | SdR={:.3f}"
                .format(
                    opt[
                        "D50"
                    ],
                    opt[
                        "D80"
                    ],
                    opt[
                        "mean_radius"
                    ],
                    opt[
                        "sd_radius"
                    ]
                )
            )

        else:

            OpticalSummary.append(
                "No valid downward work-plane footprint."
            )

        OpticalSummary.append(
            ""
        )


    OpticalSummary.extend([
        "INTERPRETATION:",
        "Current Theta metrics describe the live mechanism state.",
        "OPEN / MID / CLOSED metrics are fixed reference comparisons.",
        "Larger D80 = broader redirected field.",
        "Higher Floor-hit ratio = more sampled upward rays redirected downward.",
        "These are geometric proxy metrics, not photometric performance claims.",
        "",
        "OpticalPreview follows the CURRENT Theta continuously.",
        "Collision checking remains limited to the key portfolio states",
        "(48 / 88.623 / 107 deg) for interactive performance.",
        "",
        "END."
    ])


    Summary = [
        "=== HoberGlow GLOBAL AXIS + LIGHT FIELD V23 CURRENT-THETA OPTICAL ===",
        "",
        "STATUS: OK",
        "",
        "================================",
        "01 | UNIFIED ASSEMBLY DATUM",
        "================================",
        "",
        "GLOBAL AXIS SOURCE = UpperRing + LowerRing solid geometry.",
        "",
        "Raw inferred main centre = ({:.6f}, {:.6f}, {:.6f})"
        .format(
            raw_assembly_center.X,
            raw_assembly_center.Y,
            raw_assembly_center.Z
        ),
        "Corrected main centre = ({:.6f}, {:.6f}, {:.6f})"
        .format(
            assembly_center.X,
            assembly_center.Y,
            assembly_center.Z
        ),
        "",
        "BEFORE correction:",
        "Raw Upper canopy axis offset = {:.6f}"
        .format(
            raw_upper_axis_offset
        ),
        "Raw Lower canopy axis offset = {:.6f}"
        .format(
            raw_lower_axis_offset
        ),
        "",
        "AFTER correction:",
        "Upper canopy axis offset from main axis = {:.9f}"
        .format(
            upper_axis_offset
        ),
        "Lower canopy axis offset from main axis = {:.9f}"
        .format(
            lower_axis_offset
        ),
        "",
        "Main -> Upper ring axial spacing = {:.6f}"
        .format(
            main_to_upper_axial
        ),
        "Main -> Lower ring axial spacing = {:.6f}"
        .format(
            main_to_lower_axial
        ),
        "",
        "================================",
        "02 | CURRENT STATE",
        "================================",
        "",
        "Theta = {:.3f} deg"
        .format(
            theta_deg
        ),
        "Reference Theta = {:.6f} deg"
        .format(
            theta_ref
        ),
        "Rc = {:.6f}"
        .format(
            main_state["Rc"]
        ),
        "",
        "Upper max travel input = {:.3f} deg"
        .format(
            upper_max_travel
        ),
        "Lower max travel input = {:.3f} deg"
        .format(
            lower_max_travel
        ),
        "",
        "Current Upper petal FLIP = {:.3f} deg"
        .format(
            upper_driver["flip"]
        ),
        "Current Lower petal FLIP = {:.3f} deg"
        .format(
            lower_driver["flip"]
        ),
        "",
        "Canopy XY envelope = {:.6f}"
        .format(
            canopy_xy
        ),
        "Canopy Z height = {:.6f}"
        .format(
            canopy_z
        ),
        "",
        "Collision status = {}"
        .format(
            collision_status
        ),
        "Detected collision pairs = {}"
        .format(
            len(collision_details)
        ),
        "",
        "================================",
        "03 | AUTO UPPER FLIP LIMIT @ OPEN 48 DEG",
        "================================",
        "",
    ]


    if upper_limit_result is None:
        Summary.extend([
            "Set Theta = 48.000 deg to run the automatic",
            "Upper adjacent-petal limit search.",
            "",
        ])
    else:
        Summary.append(
            "Search status = {}"
            .format(
                upper_limit_result["status"]
            )
        )

        if upper_limit_result["last_clear"] is not None:
            Summary.append(
                "Last mesh-CLEAR UpperTravel = {:.6f} deg"
                .format(
                    upper_limit_result["last_clear"]
                )
            )

        if upper_limit_result["first_collision"] is not None:
            Summary.append(
                "First mesh-COLLISION UpperTravel = {:.6f} deg"
                .format(
                    upper_limit_result["first_collision"]
                )
            )

        if upper_limit_result["midpoint"] is not None:
            Summary.append(
                "Approx geometric transition midpoint = {:.6f} deg"
                .format(
                    upper_limit_result["midpoint"]
                )
            )

        if upper_limit_result["design_candidate"] is not None:
            Summary.append(
                "Descriptive design candidate (-0.5 deg) = {:.6f} deg"
                .format(
                    upper_limit_result["design_candidate"]
                )
            )

        Summary.extend([
            "",
            "The -0.5 deg value is a design/presentation buffer,",
            "NOT an engineering safety factor.",
            "",
        ])


    Summary.extend([
        "================================",
        "04 | NEXT",
        "================================",
        "",
        "A. First confirm alignment at Theta = 101.519817 deg.",
        "B. Then run Theta = 48 deg and read Upper limit.",
        "C. Set UpperTravel to the selected clear value.",
        "D. Recheck 48 / 88.623 / 107 deg.",
        "E. Then lock geometry and begin relative optical analysis.",
        "",
        "Result_list = complete aligned assembly geometry.",
        "Rows = 16 moved Guide lines.",
        "",
        "OPTICAL:",
        "LightGeo input is active.",
        "OpticalGeo = live current-Theta emitter/ray/work-plane preview.",
        "OpticalSummary = current Theta metrics + automatic OPEN/MID/CLOSED comparison.",
        "",
        "END."
    ])



except Exception as e:

    CheckTheta_list = []
    Zone_list = []
    OverlapPairs_list = []
    MinBBoxGap_list = []
    ClosestPair_list = []
    Result_list = []
    ExactCheckTheta_list = [
        48.0,
        88.623,
        107.0
    ]
    Rows = []
    OpticalGeo = []
    OpticalSummary = []
    AssemblyCenter = None
    AssemblyAxis = None
    AssemblyPlane = None

    FEA_AJoints = []
    FEA_BJoints = []
    FEA_PinAxis = None
    FEA_Theta = None

    Summary = [
        "=== HoberGlow GLOBAL AXIS + LIGHT FIELD V23 CURRENT-THETA OPTICAL ERROR ===",
        "",
        str(e),
        "",
        "RENAME OLD INPUTS:",
        "ThetaMin -> Theta",
        "ThetaMax -> UpperTravel",
        "Step -> LowerTravel",
        "",
        "ADD ONLY SIX INPUTS:",
        "UpperPetal : List / GeometryBase",
        "UpperRing  : Item / GeometryBase",
        "UpperGuide : Item / Curve",
        "LowerPetal : List / GeometryBase",
        "LowerRing  : Item / GeometryBase",
        "LowerGuide : Item / Curve",
        "",
        "Each black Guide line should have ONE endpoint",
        "snapped onto / very near its corresponding Ring."
    ]

# ----------------------------------------------------------------------
# PUBLIC / USER-FACING OUTPUT ALIASES
# ----------------------------------------------------------------------

Assembly = Result_list
Report = Summary
OpticalPreview = OpticalGeo
OpticalReport = OpticalSummary

# Keep these additional GhPython output ports named exactly:
#   AssemblyCenter
#   AssemblyAxis
#   AssemblyPlane
#   FEA_AJoints
#   FEA_BJoints
#   FEA_PinAxis
#   FEA_Theta
#
# IMPORTANT:
# Downstream structural topology should use FEA_AJoints / FEA_BJoints directly.
# It must NOT independently reconstruct the mechanism centre or angular phase.
# ---------- end dynamic_mechanism_optical_analysis ----------
# DYNAMIC MECHANISM GUIDE: DYNAMIC OUTPUT
# Change MECHANISM ANGLE THETA, UPPER TRAVEL and LOWER TRAVEL.
# The Assembly output previews the moving mechanism directly in Rhino.
# Read DYNAMIC MECHANISM REPORT for state and geometry diagnostics.
# OPTICAL ANALYSIS GUIDE: OPTICAL OUTPUT
# OpticalPreview draws the analysis rays/cones directly in Rhino.
# Read OPTICAL ANALYSIS REPORT for the numerical optical summary.
# The three LIGHT GEOMETRY inputs are merged and flattened before analysis.
dynamic_mechanism_report = Panel(dynamic_mechanism_optical_analysis.Report)
optical_analysis_report = Panel(dynamic_mechanism_optical_analysis.OpticalReport)

# ---- group: 03 STRUCTURAL 1/8 PROXY — 5 ELEMENTS
matselect = MaterialSelectionKaramba3D(menu=[dropdown(0), dropdown(6), dropdown(1)])
_1_8_geometry_and_topology = Python3Script(
    Theta=mechanism_angle_theta_deg,
    C_axis=center_axis_input,
    A_axis1=a_axis_1_input,
    A_axis2=a_axis_2_input,
    B_axis1=b_axis_1_input,
    B_axis2=b_axis_2_input,
    A_parts=a_parts_input,
    B_parts=b_parts_input,
    LoadMagnitude=total_ring_load_kn,
    UpperRing=upper_ring_input,
    LowerRing=lower_ring_input)  # -> A_StartIdx, A_EndIdx, A_IDs, B_StartIdx, B_EndIdx, B_IDs, Pin_StartIdx, Pin_EndIdx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; inputs Theta: Double, C_axis: Curve, A_axis1: Curve, A_axis2: Curve, B_axis1: Curve, B_axis2: Curve, A_parts: list of GeometryBase, B_parts: list of GeometryBase, UpperRing: GeometryBase, LowerRing: GeometryBase
# ---------- _1_8_geometry_and_topology: Python ----------
import math
import Rhino
import Rhino.Geometry as rg
import System
from Rhino.Geometry.Intersect import Intersection

# ============================================================
# HoberGlow FEA v03F-R5.4 — RADIAL FROZEN-STATE / NO WHOLE-RING SPIN
# DIRECT CLONE OF THE WORKING ALL-IN-ONE MECHANISM GEOMETRY
# Rhino 8 / Grasshopper Python 3
#
# KEEP EXISTING INPUTS:
#   Theta
#   C_axis
#   A_axis1
#   A_axis2
#   B_axis1
#   B_axis2
#   A_parts
#   B_parts
#   LoadMagnitude   [legacy only]
#
# ADD ONLY TWO INPUTS:
#   UpperRing : Item / GeometryBase
#   LowerRing : Item / GeometryBase
#
# No AssemblyCenter / AssemblyPlane / FEA_AJoints wires are needed.
#
# OUTPUTS:
#   NodePts
#   A_StartIdx
#   A_EndIdx
#   A_IDs
#   B_StartIdx
#   B_EndIdx
#   B_IDs
#   Pin_StartIdx
#   Pin_EndIdx
#   Pin_IDs
#   PinAxisVecs
#   CenterJointPts
#   OuterJointPts
#   BeamPreview
#   Summary
# ============================================================

NodePts = []
A_StartIdx = []
A_EndIdx = []
A_IDs = []
B_StartIdx = []
B_EndIdx = []
B_IDs = []
Pin_StartIdx = []
Pin_EndIdx = []
Pin_IDs = []
PinAxisVecs = []
CenterJointPts = []
OuterJointPts = []
BeamPreview = []
RawJointPreview = []
RadialGuides = []
Summary = []

def clamp(x, lo, hi):
    return max(lo, min(hi, x))


def dot(v1, v2):
    return rg.Vector3d.Multiply(
        rg.Vector3d(v1),
        rg.Vector3d(v2)
    )


def cross2(ax, ay, bx, by):
    return ax * by - ay * bx


def dist2(a, b):
    dx = a[0] - b[0]
    dy = a[1] - b[1]
    return math.sqrt(dx * dx + dy * dy)


def sub2(a, b):
    return (
        a[0] - b[0],
        a[1] - b[1]
    )


def rot2(pt, angle):
    x, y = pt
    c = math.cos(angle)
    s = math.sin(angle)

    return (
        c * x - s * y,
        s * x + c * y
    )


def solve_2x2(a, b, c, d, e, f):
    det = a * d - b * c

    if abs(det) < 1e-12:
        raise ValueError(
            "Kinematic matrix is singular."
        )

    return (
        (e * d - b * f) / det,
        (a * f - e * c) / det
    )


def unwrap_gh_value(value):
    """
    Best-effort unwrap for Grasshopper goo.
    With GeometryBase Type Hint, values are normally already Rhino geometry,
    but this keeps the script tolerant of wrapped inputs.
    """
    if value is None:
        return None

    if isinstance(
        value,
        rg.GeometryBase
    ):
        return value

    try:
        v = value.Value

        if isinstance(
            v,
            rg.GeometryBase
        ):
            return v
    except:
        pass

    return value


def as_line(axis_input, name, tol):
    if axis_input is None:
        raise ValueError(
            "{} is empty."
            .format(name)
        )

    if isinstance(axis_input, rg.Line):
        ln = rg.Line(
            axis_input.From,
            axis_input.To
        )

    elif isinstance(axis_input, rg.Curve):
        if not axis_input.IsLinear(tol):
            raise ValueError(
                "{} must be a straight line."
                .format(name)
            )

        ln = rg.Line(
            axis_input.PointAtStart,
            axis_input.PointAtEnd
        )

    else:
        raise ValueError(
            "{} must be a Line / linear Curve."
            .format(name)
        )

    if (
        not ln.IsValid
        or
        ln.Length <= tol
    ):
        raise ValueError(
            "{} is invalid or too short."
            .format(name)
        )

    return ln


def infinite_line_plane_point(
    line,
    plane_origin,
    plane_normal
):
    p0 = line.From
    d = line.Direction
    n = rg.Vector3d(
        plane_normal
    )

    denom = dot(
        d,
        n
    )

    if abs(denom) < 1e-12:
        raise ValueError(
            "A hinge axis is parallel to the datum plane."
        )

    t = dot(
        plane_origin - p0,
        n
    ) / denom

    return line.PointAt(
        t
    )


def point_xy(pt, origin, xaxis, yaxis):
    v = pt - origin

    return (
        dot(v, xaxis),
        dot(v, yaxis)
    )


def fit_bar(
    C,
    end1,
    end2,
    datum_x,
    datum_y,
    delta
):
    """
    Least-squares fit to the exact N=8 compatible whole rigid bar.
    """

    p1 = point_xy(
        end1,
        C,
        datum_x,
        datum_y
    )

    p2 = point_xy(
        end2,
        C,
        datum_x,
        datum_y
    )

    u1 = (
        1.0,
        0.0
    )

    u2 = (
        -math.cos(delta),
        -math.sin(delta)
    )

    candidates = [
        (p1, p2, False),
        (p2, p1, True)
    ]

    best = None

    for pA, pB, swapped in candidates:

        sum_dot = (
            u1[0] * pA[0]
            + u1[1] * pA[1]
            + u2[0] * pB[0]
            + u2[1] * pB[1]
        )

        sum_cross = (
            cross2(
                u1[0],
                u1[1],
                pA[0],
                pA[1]
            )
            +
            cross2(
                u2[0],
                u2[1],
                pB[0],
                pB[1]
            )
        )

        beta = math.atan2(
            sum_cross,
            sum_dot
        )

        cb = math.cos(
            beta
        )

        sb = math.sin(
            beta
        )

        r1 = (
            cb,
            sb
        )

        r2 = (
            cb * u2[0]
            - sb * u2[1],
            sb * u2[0]
            + cb * u2[1]
        )

        L = 0.5 * (
            r1[0] * pA[0]
            + r1[1] * pA[1]
            + r2[0] * pB[0]
            + r2[1] * pB[1]
        )

        if L <= 0.0:
            continue

        pred1 = (
            L * r1[0],
            L * r1[1]
        )

        pred2 = (
            L * r2[0],
            L * r2[1]
        )

        e1 = dist2(
            pred1,
            pA
        )

        e2 = dist2(
            pred2,
            pB
        )

        rms = math.sqrt(
            0.5 * (
                e1 * e1
                + e2 * e2
            )
        )

        candidate = {
            "L": L,
            "beta": beta,
            "rms": rms,
            "swapped": swapped
        }

        if (
            best is None
            or
            rms < best["rms"]
        ):
            best = candidate

    if best is None:
        raise ValueError(
            "Could not fit a rigid bar."
        )

    return best


def source_frame_from_fit(
    C,
    datum_x,
    datum_y,
    fit
):
    beta = fit[
        "beta"
    ]

    cb = math.cos(
        beta
    )

    sb = math.sin(
        beta
    )

    x = (
        rg.Vector3d(
            datum_x
        ) * cb
        +
        rg.Vector3d(
            datum_y
        ) * sb
    )

    y = (
        rg.Vector3d(
            datum_x
        ) * (-sb)
        +
        rg.Vector3d(
            datum_y
        ) * cb
    )

    x.Unitize()
    y.Unitize()

    return rg.Plane(
        C,
        x,
        y
    )


def target_frame_in_datum(
    assembly_center,
    datum_x,
    datum_y,
    ox,
    oy,
    angle
):
    """
    Build target bar frame in the ORIGINAL Rhino datum.
    """
    origin = (
        assembly_center
        + rg.Vector3d(datum_x) * ox
        + rg.Vector3d(datum_y) * oy
    )

    ca = math.cos(angle)
    sa = math.sin(angle)

    x = (
        rg.Vector3d(datum_x) * ca
        + rg.Vector3d(datum_y) * sa
    )

    y = (
        rg.Vector3d(datum_x) * (-sa)
        + rg.Vector3d(datum_y) * ca
    )

    x.Unitize()
    y.Unitize()

    return rg.Plane(
        origin,
        x,
        y
    )


def solve_main_state(
    theta_deg,
    LA,
    LB,
    delta,
    N
):
    """
    HoberGlow frozen-state scissor solution with GLOBAL DE-SPIN.

    The original cyclic-closure equations are kept exactly.
    Only the whole-ring rigid-body phase about the global centre is removed.

    This makes the eight C pivots stay on eight fixed radial rays:
      azimuth(C_i) = constant
      radius(C_i)  = function of Theta

    Internal member lengths, A/B relative angles and closure are unchanged.
    """

    PHASE_REF_DEG = 101.519817

    def raw_c0(theta_rad):
        a2 = (
            -LA * math.cos(delta),
            -LA * math.sin(delta)
        )

        b1 = (
            LB,
            0.0
        )

        Rdb1 = rot2(
            b1,
            theta_rad + delta
        )

        rhs = sub2(
            a2,
            Rdb1
        )

        cd = math.cos(delta)
        sd = math.sin(delta)

        return solve_2x2(
            cd - 1.0,
            -sd,
            sd,
            cd - 1.0,
            rhs[0],
            rhs[1]
        )

    theta = math.radians(
        theta_deg
    )

    C0_raw = raw_c0(
        theta
    )

    C0_ref = raw_c0(
        math.radians(
            PHASE_REF_DEG
        )
    )

    phi_now = math.atan2(
        C0_raw[1],
        C0_raw[0]
    )

    phi_ref = math.atan2(
        C0_ref[1],
        C0_ref[0]
    )

    # Counter-rotation that removes whole-ring angular drift.
    phase_fix = (
        phi_ref - phi_now
    )

    C0 = rot2(
        C0_raw,
        phase_fix
    )

    bars = []

    for i in range(
        N
    ):
        base_angle = (
            i * delta
        )

        # C_i lies on a fixed ray because C0 has fixed polar phase.
        Ci = rot2(
            C0,
            base_angle
        )

        # Apply the same rigid-body phase correction to member orientations.
        ai = (
            base_angle
            + phase_fix
        )

        bi = (
            theta
            + base_angle
            + phase_fix
        )

        bars.append({
            "id": "A{}".format(i),
            "kind": "A",
            "origin": Ci,
            "angle": ai
        })

        bars.append({
            "id": "B{}".format(i),
            "kind": "B",
            "origin": Ci,
            "angle": bi
        })

    Rc = math.sqrt(
        C0_raw[0] * C0_raw[0]
        +
        C0_raw[1] * C0_raw[1]
    )

    return {
        "bars": bars,
        "Rc": Rc,
        "phase_fix_deg": math.degrees(
            phase_fix
        ),
        "phase_ref_deg": math.degrees(
            phi_ref
        )
    }


def extract_single_input_value(value):
    """
    Robustly unwrap one expected Grasshopper input.

    This is intentionally used ONLY for single-value inputs such as:
        UpperRing
        LowerRing
        UpperGuide
        LowerGuide

    It accepts:
        Rhino.Geometry
        GH goo with .Value
        one-item Python list/tuple
        one-item / one-branch DataTree

    If a tree/list contains several values, the first non-null value is used.
    That keeps old GH files compatible after switching other ports to Tree Access.
    """

    if value is None:
        return None

    # Already a Rhino value.
    if isinstance(
        value,
        (
            rg.GeometryBase,
            rg.Line
        )
    ):
        return value

    # Grasshopper goo wrapper, e.g. GH_Curve / GH_Brep / GH_Line.
    try:
        wrapped = value.Value

        if wrapped is not None:
            return extract_single_input_value(
                wrapped
            )
    except:
        pass

    # Grasshopper DataTree / GH_Structure.
    try:
        data = list(
            value.AllData()
        )

        for item in data:
            result = extract_single_input_value(
                item
            )

            if result is not None:
                return result
    except:
        pass

    # Structure exposing Branches but not AllData().
    try:
        for branch in value.Branches:
            for item in branch:
                result = extract_single_input_value(
                    item
                )

                if result is not None:
                    return result
    except:
        pass

    # Normal iterable fallback.
    try:
        for item in value:
            result = extract_single_input_value(
                item
            )

            if result is not None:
                return result
    except:
        pass

    return value


def as_brep(value, name):
    """
    Resolve a Grasshopper/Rhino reference to one Brep.

    Robust to either:
      - GeometryBase/Brep input (recommended Type Hint), or
      - System.Guid input from a generic Object/ghdoc reference.

    This makes UpperRing/LowerRing work even if the GhPython input
    Type Hint was accidentally left as Object.
    """

    value = extract_single_input_value(
        value
    )

    if value is None:
        raise ValueError(
            "{} is empty."
            .format(name)
        )

    # --------------------------------------------------------
    # 1. Resolve Rhino document Guid -> GeometryBase
    # --------------------------------------------------------
    if isinstance(value, System.Guid):
        doc = Rhino.RhinoDoc.ActiveDoc

        if doc is None:
            raise ValueError(
                "{} is a Guid but no active Rhino document is available."
                .format(name)
            )

        geo = doc.Objects.FindGeometry(
            value
        )

        if geo is None:
            raise ValueError(
                "{} Guid could not be resolved in the active Rhino document: {}"
                .format(
                    name,
                    value
                )
            )

        value = geo

    # --------------------------------------------------------
    # 2. Also support Rhino ObjRef, if one is ever passed
    # --------------------------------------------------------
    try:
        if isinstance(value, Rhino.DocObjects.ObjRef):
            geo = value.Geometry()

            if geo is None:
                raise ValueError(
                    "{} ObjRef contains no geometry."
                    .format(name)
                )

            value = geo
    except Exception:
        pass

    # --------------------------------------------------------
    # 3. Direct Brep
    # --------------------------------------------------------
    if isinstance(value, rg.Brep):
        return value

    # --------------------------------------------------------
    # 4. Convert other solid-like GeometryBase types to Brep
    # --------------------------------------------------------
    try:
        brep = rg.Brep.TryConvertBrep(
            value
        )
    except Exception:
        brep = None

    if brep is None:
        raise ValueError(
            "{} must resolve to ONE Brep / solid-like GeometryBase; received {}."
            .format(
                name,
                type(value).__name__
            )
        )

    return brep


def percentile(values, q):
    if not values:
        return None

    vals = sorted(values)

    if len(vals) == 1:
        return vals[0]

    pos = (
        len(vals) - 1
    ) * q

    lo = int(
        math.floor(pos)
    )

    hi = int(
        math.ceil(pos)
    )

    if lo == hi:
        return vals[lo]

    t = (
        pos - lo
    )

    return (
        vals[lo] * (1.0 - t)
        + vals[hi] * t
    )

def ring_solid_center_circle(
    ring_geo,
    axis_normal,
    name,
    tol
):
    """
    Extract a virtual circular centre-path from the ACTUAL SOLID ring.

    1. Convert the ring to Brep.
    2. Section it through its middle with a plane perpendicular
       to the main C_axis.
    3. Sample the resulting inner / outer circular section curves.
    4. Average the inner / outer radii.

    The user does NOT need to draw a centreline curve.
    """

    brep = as_brep(
        ring_geo,
        name
    )

    bb = brep.GetBoundingBox(
        True
    )

    if not bb.IsValid:
        raise ValueError(
            "{} bounding box is invalid."
            .format(name)
        )

    center = rg.Point3d(
        0.5 * (bb.Min.X + bb.Max.X),
        0.5 * (bb.Min.Y + bb.Max.Y),
        0.5 * (bb.Min.Z + bb.Max.Z)
    )

    n = rg.Vector3d(
        axis_normal
    )

    if n.IsTiny():
        raise ValueError(
            "Main C_axis direction is invalid."
        )

    n.Unitize()

    section_plane = rg.Plane(
        center,
        n
    )

    result = Intersection.BrepPlane(
        brep,
        section_plane,
        tol
    )

    if not isinstance(
        result,
        tuple
    ):
        raise ValueError(
            "{} BrepPlane returned an unexpected result."
            .format(name)
        )

    if (
        len(result) < 3
        or
        not result[0]
    ):
        raise ValueError(
            "Could not section {} through its mid-plane."
            .format(name)
        )

    curves = result[1]

    if (
        curves is None
        or
        len(curves) == 0
    ):
        raise ValueError(
            "{} mid-plane produced no section curves."
            .format(name)
        )

    radii = []

    for crv in curves:

        if crv is None:
            continue

        params = crv.DivideByCount(
            48,
            True
        )

        if (
            params is None
            or
            len(params) == 0
        ):
            pts = [
                crv.PointAtStart,
                crv.PointAtEnd
            ]
        else:
            pts = [
                crv.PointAt(t)
                for t in params
            ]

        for pt in pts:

            v = rg.Vector3d(
                pt - center
            )

            axial = dot(
                v,
                n
            )

            planar = (
                v
                - n * axial
            )

            r = planar.Length

            if r > tol:
                radii.append(
                    r
                )

    if len(radii) < 8:
        raise ValueError(
            "Not enough section samples from {}."
            .format(name)
        )

    rs = sorted(
        radii
    )

    # Find the strongest split between inner and outer radius bands.
    best_i = None
    best_gap = -1.0

    for i in range(
        1,
        len(rs)
    ):

        gap = (
            rs[i]
            - rs[i - 1]
        )

        if gap > best_gap:
            best_gap = gap
            best_i = i

    if (
        best_i is None
        or
        best_i <= 0
        or
        best_i >= len(rs)
    ):
        raise ValueError(
            "Could not separate inner / outer radius bands for {}."
            .format(name)
        )

    inner_cluster = rs[:best_i]
    outer_cluster = rs[best_i:]

    r_inner = percentile(
        inner_cluster,
        0.5
    )

    r_outer = percentile(
        outer_cluster,
        0.5
    )

    if (
        r_inner is None
        or
        r_outer is None
        or
        r_outer <= r_inner
    ):
        raise ValueError(
            "Invalid extracted ring radii for {}."
            .format(name)
        )

    r_center = 0.5 * (
        r_inner
        + r_outer
    )

    circle = rg.Circle(
        section_plane,
        r_center
    )

    return {
        "brep": brep,
        "circle": circle,
        "r_inner": r_inner,
        "r_outer": r_outer,
        "r_center": r_center
    }

def safe_count(items):
    try:
        if items is None:
            return 0
        return len(items)
    except Exception:
        return 0


def midpoint(a, b):
    return rg.Point3d(
        0.5 * (a.X + b.X),
        0.5 * (a.Y + b.Y),
        0.5 * (a.Z + b.Z)
    )


def greedy_bipartite_pairing(a_records, b_records):
    candidates = []

    for ai, a in enumerate(a_records):
        for bi, b in enumerate(b_records):
            candidates.append((
                a["pt"].DistanceTo(b["pt"]),
                ai,
                bi
            ))

    candidates.sort(key=lambda x: x[0])

    used_a = set()
    used_b = set()
    matches = []

    for d, ai, bi in candidates:
        if ai in used_a or bi in used_b:
            continue

        used_a.add(ai)
        used_b.add(bi)
        matches.append((ai, bi, d))

        if len(matches) == 16:
            break

    if len(matches) != 16:
        raise ValueError(
            "Could not build 16 one-to-one outer A/B pivot matches."
        )

    return matches


try:
    try:
        doc_tol = (
            Rhino.RhinoDoc.ActiveDoc.ModelAbsoluteTolerance
        )
    except Exception:
        doc_tol = 0.001

    tol = max(float(doc_tol), 1e-8)

    # --------------------------------------------------------
    # 1. LIVE THETA — SAME DEFAULT/CLAMP AS ALL-IN-ONE
    # --------------------------------------------------------

    THETA_REF = 101.519817

    theta_deg = (
        THETA_REF
        if Theta is None
        else float(Theta)
    )

    theta_deg = clamp(
        theta_deg,
        1.0,
        134.9
    )

    # --------------------------------------------------------
    # 2. SAME FIVE-AXIS CALIBRATION AS ALL-IN-ONE
    # --------------------------------------------------------

    LC = as_line(C_axis, "C_axis", tol)
    LA1line = as_line(A_axis1, "A_axis1", tol)
    LA2line = as_line(A_axis2, "A_axis2", tol)
    LB1line = as_line(B_axis1, "B_axis1", tol)
    LB2line = as_line(B_axis2, "B_axis2", tol)

    C = LC.PointAt(0.5)

    Z = rg.Vector3d(LC.Direction)

    if Z.IsTiny():
        raise ValueError("C_axis has zero direction.")

    Z.Unitize()

    # --------------------------------------------------------
    # 3. SAME GLOBAL AXIS FROM THE TWO REAL RINGS
    # --------------------------------------------------------

    upper_ring_global = ring_solid_center_circle(
        UpperRing,
        Z,
        "UpperRing",
        tol
    )

    lower_ring_global = ring_solid_center_circle(
        LowerRing,
        Z,
        "LowerRing",
        tol
    )

    upper_global_center = upper_ring_global["circle"].Center
    lower_global_center = lower_ring_global["circle"].Center

    canopy_axis_origin = rg.Point3d(
        0.5 * (upper_global_center.X + lower_global_center.X),
        0.5 * (upper_global_center.Y + lower_global_center.Y),
        0.5 * (upper_global_center.Z + lower_global_center.Z)
    )

    # --------------------------------------------------------
    # 4. SAME SOURCE DATUM + SAME FIT_BAR()
    # --------------------------------------------------------

    A1 = infinite_line_plane_point(LA1line, C, Z)
    A2 = infinite_line_plane_point(LA2line, C, Z)
    B1 = infinite_line_plane_point(LB1line, C, Z)
    B2 = infinite_line_plane_point(LB2line, C, Z)

    X = rg.Vector3d(A1 - C)

    if X.IsTiny():
        X = rg.Vector3d(B1 - C)

    X.Unitize()

    Y = rg.Vector3d.CrossProduct(Z, X)

    if Y.IsTiny():
        raise ValueError(
            "Could not construct main datum frame."
        )

    Y.Unitize()

    N = 8
    delta = 2.0 * math.pi / float(N)

    fitA = fit_bar(
        C, A1, A2, X, Y, delta
    )

    fitB = fit_bar(
        C, B1, B2, X, Y, delta
    )

    LA = fitA["L"]
    LB = fitB["L"]

    source_A = source_frame_from_fit(
        C, X, Y, fitA
    )

    source_B = source_frame_from_fit(
        C, X, Y, fitB
    )

    betaA_deg = math.degrees(fitA["beta"])
    betaB_deg = math.degrees(fitB["beta"])

    raw_ref = (
        betaB_deg - betaA_deg
    ) % 360.0

    theta_ref = min(
        raw_ref,
        360.0 - raw_ref
    )

    # --------------------------------------------------------
    # 5. SAME GLOBAL-CENTRE CORRECTION AS ALL-IN-ONE
    # --------------------------------------------------------

    reference_state = solve_main_state(
        theta_ref,
        LA,
        LB,
        delta,
        N
    )

    ref_c0_x, ref_c0_y = (
        reference_state["bars"][0]["origin"]
    )

    raw_assembly_center = (
        C
        - rg.Vector3d(X) * ref_c0_x
        - rg.Vector3d(Y) * ref_c0_y
    )

    raw_from_canopy_axis = rg.Vector3d(
        raw_assembly_center - canopy_axis_origin
    )

    axial_coordinate = dot(
        raw_from_canopy_axis,
        Z
    )

    assembly_center = (
        canopy_axis_origin
        + rg.Vector3d(Z) * axial_coordinate
    )

    # --------------------------------------------------------
    # 6. SAME CURRENT solve_main_state + PlaneToPlane TRANSFORMS
    # --------------------------------------------------------

    main_state = solve_main_state(
        theta_deg,
        LA,
        LB,
        delta,
        N
    )

    A_members = []
    B_members = []

    for bar in main_state["bars"]:

        ox, oy = bar["origin"]

        frame = target_frame_in_datum(
            assembly_center,
            X,
            Y,
            ox,
            oy,
            bar["angle"]
        )

        if bar["kind"] == "A":

            xf = rg.Transform.PlaneToPlane(
                source_A,
                frame
            )

            p1 = rg.Point3d(A1)
            pc = rg.Point3d(C)
            p2 = rg.Point3d(A2)

            p1.Transform(xf)
            pc.Transform(xf)
            p2.Transform(xf)

            A_members.append({
                "end1": p1,
                "C": pc,
                "end2": p2,
                "id": bar["id"]
            })

        else:

            xf = rg.Transform.PlaneToPlane(
                source_B,
                frame
            )

            p1 = rg.Point3d(B1)
            pc = rg.Point3d(C)
            p2 = rg.Point3d(B2)

            p1.Transform(xf)
            pc.Transform(xf)
            p2.Transform(xf)

            B_members.append({
                "end1": p1,
                "C": pc,
                "end2": p2,
                "id": bar["id"]
            })

    if len(A_members) != 8:
        raise ValueError(
            "Expected 8 transformed A members; got {}."
            .format(len(A_members))
        )

    if len(B_members) != 8:
        raise ValueError(
            "Expected 8 transformed B members; got {}."
            .format(len(B_members))
        )

    # --------------------------------------------------------
    # RAW DEBUG PREVIEW — ALWAYS AVAILABLE AFTER TRANSFORMS
    # --------------------------------------------------------
    # 48 transformed hinge points:
    # A: End1, C, End2 x 8
    # B: End1, C, End2 x 8
    # This is intentionally populated BEFORE any topology validation.
    RawJointPreview = []

    for i in range(N):
        RawJointPreview.extend([
            rg.Point3d(A_members[i]["end1"]),
            rg.Point3d(A_members[i]["C"]),
            rg.Point3d(A_members[i]["end2"]),
            rg.Point3d(B_members[i]["end1"]),
            rg.Point3d(B_members[i]["C"]),
            rg.Point3d(B_members[i]["end2"]),
        ])

    # Also expose raw centre pivots immediately.
    CenterJointPts = [
        rg.Point3d(A_members[i]["C"])
        for i in range(N)
    ]

    # --------------------------------------------------------
    # 7. CENTER PIVOTS
    # --------------------------------------------------------

    center_gaps = [
        A_members[i]["C"].DistanceTo(
            B_members[i]["C"]
        )
        for i in range(N)
    ]

    max_center_gap = max(center_gaps)

    char_lengths = []

    for i in range(N):
        char_lengths.append(
            A_members[i]["end1"].DistanceTo(
                A_members[i]["end2"]
            )
        )
        char_lengths.append(
            B_members[i]["end1"].DistanceTo(
                B_members[i]["end2"]
            )
        )

    char_length = (
        sum(char_lengths)
        / float(len(char_lengths))
    )

    joint_snap_tol = max(
        tol * 10.0,
        char_length * 0.005
    )

    if max_center_gap > joint_snap_tol:
        raise ValueError(
            "Centre pivots do not coincide. "
            "Max gap = {:.6f}; allowed = {:.6f}."
            .format(
                max_center_gap,
                joint_snap_tol
            )
        )

    for i in range(N):
        c_mid = midpoint(
            A_members[i]["C"],
            B_members[i]["C"]
        )

        A_members[i]["C"] = rg.Point3d(c_mid)
        B_members[i]["C"] = rg.Point3d(c_mid)

    # --------------------------------------------------------
    # 8. OUTER PIVOTS — PAIR BY ACTUAL 3D POSITION
    # --------------------------------------------------------

    A_outer = []
    B_outer = []

    for i in range(N):
        A_outer.append({
            "member": i,
            "which": "end1",
            "pt": rg.Point3d(A_members[i]["end1"])
        })
        A_outer.append({
            "member": i,
            "which": "end2",
            "pt": rg.Point3d(A_members[i]["end2"])
        })

        B_outer.append({
            "member": i,
            "which": "end1",
            "pt": rg.Point3d(B_members[i]["end1"])
        })
        B_outer.append({
            "member": i,
            "which": "end2",
            "pt": rg.Point3d(B_members[i]["end2"])
        })

    matches = greedy_bipartite_pairing(
        A_outer,
        B_outer
    )

    outer_gaps = [
        d for _, _, d in matches
    ]

    max_outer_gap = max(outer_gaps)

    if max_outer_gap > joint_snap_tol:
        raise ValueError(
            "Outer pivots do not coincide closely enough. "
            "Max matched gap = {:.6f}; allowed = {:.6f}."
            .format(
                max_outer_gap,
                joint_snap_tol
            )
        )

    outer_match_records = []

    for ai, bi, d in matches:

        ar = A_outer[ai]
        br = B_outer[bi]

        p_mid = midpoint(
            ar["pt"],
            br["pt"]
        )

        A_members[ar["member"]][ar["which"]] = rg.Point3d(p_mid)
        B_members[br["member"]][br["which"]] = rg.Point3d(p_mid)

        outer_match_records.append({
            "A_member": ar["member"],
            "A_which": ar["which"],
            "B_member": br["member"],
            "B_which": br["which"],
            "gap": d,
            "point": rg.Point3d(p_mid)
        })

    # --------------------------------------------------------
    # 9. EXPLICIT DUPLICATE NODE TABLE
    # --------------------------------------------------------

    node_map = {}

    for i in range(N):
        base = 6 * i

        node_map[("A_end1", i)] = base + 0
        node_map[("A_C", i)] = base + 1
        node_map[("A_end2", i)] = base + 2

        node_map[("B_end1", i)] = base + 3
        node_map[("B_C", i)] = base + 4
        node_map[("B_end2", i)] = base + 5

        NodePts.extend([
            rg.Point3d(A_members[i]["end1"]),
            rg.Point3d(A_members[i]["C"]),
            rg.Point3d(A_members[i]["end2"]),
            rg.Point3d(B_members[i]["end1"]),
            rg.Point3d(B_members[i]["C"]),
            rg.Point3d(B_members[i]["end2"]),
        ])

    # --------------------------------------------------------
    # 10. 32 BEAM SEGMENTS + PREVIEW
    # --------------------------------------------------------

    for i in range(N):

        A_StartIdx.extend([
            node_map[("A_end1", i)],
            node_map[("A_C", i)]
        ])

        A_EndIdx.extend([
            node_map[("A_C", i)],
            node_map[("A_end2", i)]
        ])

        A_IDs.extend([
            "A{}a".format(i),
            "A{}b".format(i)
        ])

        B_StartIdx.extend([
            node_map[("B_end1", i)],
            node_map[("B_C", i)]
        ])

        B_EndIdx.extend([
            node_map[("B_C", i)],
            node_map[("B_end2", i)]
        ])

        B_IDs.extend([
            "B{}a".format(i),
            "B{}b".format(i)
        ])

        BeamPreview.extend([
            rg.LineCurve(
                A_members[i]["end1"],
                A_members[i]["C"]
            ),
            rg.LineCurve(
                A_members[i]["C"],
                A_members[i]["end2"]
            ),
            rg.LineCurve(
                B_members[i]["end1"],
                B_members[i]["C"]
            ),
            rg.LineCurve(
                B_members[i]["C"],
                B_members[i]["end2"]
            ),
        ])

    # --------------------------------------------------------
    # 11. 24 ZERO-LENGTH PIN CONNECTORS
    # --------------------------------------------------------

    for i in range(N):

        Pin_StartIdx.append(
            node_map[("A_C", i)]
        )

        Pin_EndIdx.append(
            node_map[("B_C", i)]
        )

        Pin_IDs.append(
            "PIN_C{}".format(i)
        )

        PinAxisVecs.append(
            rg.Vector3d(Z)
        )

    for k, rec in enumerate(
        outer_match_records
    ):

        Pin_StartIdx.append(
            node_map[
                (
                    "A_" + rec["A_which"],
                    rec["A_member"]
                )
            ]
        )

        Pin_EndIdx.append(
            node_map[
                (
                    "B_" + rec["B_which"],
                    rec["B_member"]
                )
            ]
        )

        Pin_IDs.append(
            "PIN_O{:02d}".format(k)
        )

        PinAxisVecs.append(
            rg.Vector3d(Z)
        )

    CenterJointPts = [
        rg.Point3d(A_members[i]["C"])
        for i in range(N)
    ]

    OuterJointPts = [
        rg.Point3d(rec["point"])
        for rec in outer_match_records
    ]


    # --------------------------------------------------------
    # RADIAL GUIDE PREVIEW
    # --------------------------------------------------------
    # Each CenterJointPt must remain on one of these rays as Theta changes.
    RadialGuides = []

    for p in CenterJointPts:
        v = rg.Vector3d(
            p - assembly_center
        )

        if v.IsTiny():
            continue

        # Draw a ray 25% beyond the current C position.
        q = (
            assembly_center
            + rg.Vector3d(v) * 1.25
        )

        RadialGuides.append(
            rg.LineCurve(
                assembly_center,
                q
            )
        )

    # --------------------------------------------------------
    # 12. HARD AUDIT
    # --------------------------------------------------------

    if len(NodePts) != 48:
        raise ValueError(
            "Expected 48 node entries; got {}."
            .format(len(NodePts))
        )

    if len(A_IDs) != 16:
        raise ValueError(
            "Expected 16 A beam segments."
        )

    if len(B_IDs) != 16:
        raise ValueError(
            "Expected 16 B beam segments."
        )

    if len(Pin_IDs) != 24:
        raise ValueError(
            "Expected 24 zero-length pins."
        )

    pin_lengths = []

    for ia, ib in zip(
        Pin_StartIdx,
        Pin_EndIdx
    ):
        pin_lengths.append(
            NodePts[ia].DistanceTo(
                NodePts[ib]
            )
        )

    max_pin_length = max(pin_lengths)

    if max_pin_length > max(
        tol * 0.01,
        1e-10
    ):
        raise ValueError(
            "Zero-length pin audit failed. "
            "Max pin length = {:.9e}."
            .format(max_pin_length)
        )

    # --------------------------------------------------------
    # 13. 1/8 CYCLIC-SECTOR PROXY FOR THE 20-ELEMENT TRIAL LIMIT
    # --------------------------------------------------------
    # The complete ring above remains the geometry authority and is audited
    # before reduction. Karamba receives only sector 0. The full visible
    # mechanism stays eightfold; results from this model are sector-proxy
    # results and may only be copied rotationally for symmetric cases.

    full_ring_node_count = len(NodePts)
    full_ring_A_count = len(A_IDs)
    full_ring_B_count = len(B_IDs)
    full_ring_pin_count = len(Pin_IDs)

    NodePts = [rg.Point3d(NodePts[i]) for i in range(6)]
    A_StartIdx = [0, 1]
    A_EndIdx = [1, 2]
    A_IDs = ["A0a", "A0b"]
    B_StartIdx = [3, 4]
    B_EndIdx = [4, 5]
    B_IDs = ["B0a", "B0b"]
    Pin_StartIdx = [1]
    Pin_EndIdx = [4]
    Pin_IDs = ["PIN_C0"]
    PinAxisVecs = [rg.Vector3d(Z)]
    CenterJointPts = [rg.Point3d(NodePts[1])]
    OuterJointPts = [
        rg.Point3d(NodePts[0]), rg.Point3d(NodePts[2]),
        rg.Point3d(NodePts[3]), rg.Point3d(NodePts[5])
    ]

    if not (
        len(NodePts) == 6 and len(A_IDs) == 2 and
        len(B_IDs) == 2 and len(Pin_IDs) == 1
    ):
        raise ValueError("1/8 proxy reduction failed")

    # --------------------------------------------------------
    # 14. SUMMARY
    # --------------------------------------------------------

    state_name = "CUSTOM"

    if abs(theta_deg - 48.0) < 0.05:
        state_name = "OPEN"
    elif abs(theta_deg - 88.623) < 0.05:
        state_name = "MID"
    elif abs(theta_deg - 107.0) < 0.05:
        state_name = "CLOSED"

    unit_name = "Unknown"

    try:
        doc = Rhino.RhinoDoc.ActiveDoc
        if doc is not None:
            unit_name = str(doc.ModelUnitSystem)
    except Exception:
        pass

    Summary = [
        "=== HoberGlow FEA v03F-R5.4 RADIAL FROZEN-STATE DIRECT ALL-IN-ONE CLONE ===",
        "",
        "STATUS: 1/8 CYCLIC-SECTOR PROXY GENERATED",
        "ACTIVE KARAMBA MODEL = 5 ELEMENTS (4 BEAMS + 1 PIN SPRING)",
        "TRIAL LIMIT CHECK = PASS BY MODEL REDUCTION, NOT LICENSE BYPASS",
        "ABSOLUTE RESULT STATUS: NOT VALID YET",
        "",
        "GEOMETRY SOURCE:",
        "Direct copy of the working ALL-IN-ONE mechanism geometry logic.",
        "No cross-component centre/plane/joint wiring is used.",
        "",
        "STATE = {} | Theta = {:.3f} deg"
        .format(
            state_name,
            theta_deg
        ),
        "FEA frame = RADIAL FROZEN-STATE",
        "Whole-ring phase removed = {:.6f} deg"
        .format(
            main_state["phase_fix_deg"]
        ),
        "C pivots: fixed azimuth / variable radius",
        "",
        "GLOBAL DATUM:",
        "UpperRing centre = ({:.6f}, {:.6f}, {:.6f})"
        .format(
            upper_global_center.X,
            upper_global_center.Y,
            upper_global_center.Z
        ),
        "LowerRing centre = ({:.6f}, {:.6f}, {:.6f})"
        .format(
            lower_global_center.X,
            lower_global_center.Y,
            lower_global_center.Z
        ),
        "Corrected assembly centre = ({:.6f}, {:.6f}, {:.6f})"
        .format(
            assembly_center.X,
            assembly_center.Y,
            assembly_center.Z
        ),
        "",
        "CALIBRATION:",
        "Reference Theta = {:.6f} deg".format(theta_ref),
        "A half-length LA = {:.6f}".format(LA),
        "B half-length LB = {:.6f}".format(LB),
        "A source fit RMS = {:.9f}".format(fitA["rms"]),
        "B source fit RMS = {:.9f}".format(fitB["rms"]),
        "",
        "TOPOLOGY:",
        "Full ring audited = 48 nodes / 32 beam segments / 24 pin springs",
        "Active proxy physical members = 2 (1 A + 1 B)",
        "Active proxy beam segments = 4",
        "Active proxy centre pin springs = 1",
        "Active proxy node entries = 6",
        "",
        "JOINT AUDIT:",
        "Characteristic member length = {:.6f}".format(char_length),
        "Joint snap tolerance = {:.6f}".format(joint_snap_tol),
        "Max centre gap before snap = {:.9f}".format(max_center_gap),
        "Max outer matched gap before snap = {:.9f}".format(max_outer_gap),
        "Max pin length after snap = {:.9e}".format(max_pin_length),
        "",
        "RHINO UNIT = {}".format(unit_name),
        "",
        "KARAMBA WIRING:",
        "NodePts -> Assemble Model / Pts",
        "A_StartIdx/A_EndIdx/A_IDs -> A IndToBeam",
        "B_StartIdx/B_EndIdx/B_IDs -> B IndToBeam",
        "Pin_StartIdx/Pin_EndIdx/Pin_IDs -> PIN IndToBeam",
        "",
        "DO NOT use old v02B C0/C4 rigid coupling.",
        "LoadMagnitude is interpreted as TOTAL RING LOAD [kN].",
        "Active sector receives Total/8; A and B centre loads each receive Total/16.",
        "Proxy boundary = nodes 0,2,3,5: translations fixed, rotations released.",
        "Use only for eightfold symmetric geometry, material, boundary and loading.",
        "",
        "END."
    ]


except Exception as e:

    # Clear only outputs that would be unsafe to send to Karamba.
    # Keep RawJointPreview / CenterJointPts / BeamPreview if they were
    # already computed, so geometry errors remain visible in Rhino.
    NodePts = []

    A_StartIdx = []
    A_EndIdx = []
    A_IDs = []

    B_StartIdx = []
    B_EndIdx = []
    B_IDs = []

    Pin_StartIdx = []
    Pin_EndIdx = []
    Pin_IDs = []
    PinAxisVecs = []

    OuterJointPts = []

    Summary = [
        "=== HoberGlow FEA v03F-R5.4 RADIAL FROZEN-STATE ERROR ===",
        "",
        str(e),
        "",
        "KEEP EXISTING INPUTS.",
        "ADD ONLY:",
        "UpperRing : Item / GeometryBase",
        "LowerRing : Item / GeometryBase",
        "",
        "Use the SAME Rhino ring inputs as ALL-IN-ONE.",
    ]
# ---------- end _1_8_geometry_and_topology ----------
sector_load_controller_total_8 = Python3Script(
    Theta=mechanism_angle_theta_deg,
    C_axis=center_axis_input,
    A_axis1=a_axis_1_input,
    A_axis2=a_axis_2_input,
    B_axis1=b_axis_1_input,
    B_axis2=b_axis_2_input,
    A_parts=a_parts_input,
    B_parts=b_parts_input,
    LoadMagnitude=total_ring_load_kn)  # -> BeamLines, BeamIDs, A_BeamLines, B_BeamLines, SupportPts, LoadBeamIDs, LoadVecs, LoadT, JointPts, Summary; inputs Theta: Double, C_axis: Curve, A_axis1: Curve, A_axis2: Curve, B_axis1: Curve, B_axis2: Curve, A_parts: list of GeometryBase, B_parts: list of GeometryBase
# ---------- sector_load_controller_total_8: Python ----------
import Rhino.Geometry as rg

BeamLines = []
BeamIDs = []
A_BeamLines = []
B_BeamLines = []
SupportPts = []
JointPts = []

try:
    total_ring_load = abs(float(LoadMagnitude))
except Exception:
    try:
        total_ring_load = abs(float(LoadMagnitude.Value))
    except Exception:
        total_ring_load = 0.0

sector_load = total_ring_load / 8.0
each_centre_load = sector_load / 2.0

LoadBeamIDs = ["A0a", "B0a"]
LoadVecs = [
    rg.Vector3d(0.0, 0.0, -each_centre_load),
    rg.Vector3d(0.0, 0.0, -each_centre_load)
]
LoadT = [1.0, 1.0]

Summary = [
    "=== HoberGlow 1/8 SECTOR LOAD CONTROLLER ===",
    "Geometry/kinematics recalculated here = NO",
    "Total ring load = {:.6g} kN".format(total_ring_load),
    "Sector load = Total/8 = {:.6g} kN".format(sector_load),
    "Two centre loads = Total/16 each = {:.6g} kN".format(each_centre_load),
    "Active element IDs = A0a, A0b, B0a, B0b, PIN_C0",
    "Active Karamba element count = 5 <= 20",
    "Boundary nodes = 0,2,3,5; translations fixed; rotations free",
    "Validity = symmetric 1/8 proxy only",
    "END"
]
# ---------- end sector_load_controller_total_8 ----------
b_member_id_b = Panel("&B.*")
a_member_id_a = Panel("&A.*")
o_section = CrossSectionKaramba3D(
    FamilyNameOfCrossSection="A_Family",
    NameOfCrossSection="A_Tube",
    ElementIdentifier=b_member_id_b,
    Material=matselect,
    Diameter_cm=11.43,
    WallThickness_cm=0.4,
    mode="Circular Hollow")
o_section_2 = CrossSectionKaramba3D(
    FamilyNameOfCrossSection="A_Family",
    NameOfCrossSection="A_Tube",
    ElementIdentifier=a_member_id_a,
    Material=matselect,
    Diameter_cm=11.43,
    WallThickness_cm=0.4,
    mode="Circular Hollow")
b_section_profile_extractor = Python3Script(MemberGeo=a_parts_input, EndAxis1=a_axis_1_input, CenterAxis=center_axis_input, EndAxis2=a_axis_2_input, Divisions=5)  # -> SectionsYZ_mm, SectionsYZ_cm, RawSections, SectionPlanes, PreviewWall, Report, CleanSections_cm, ReviewSections_cm, SectionClass; inputs MemberGeo: list of GeometryBase, EndAxis1: Line, CenterAxis: Line, EndAxis2: Line
# ---------- b_section_profile_extractor: Python ----------
import math
import Rhino
import Rhino.Geometry as rg
from Rhino.Geometry.Intersect import Intersection
import Grasshopper
from Grasshopper import DataTree
from Grasshopper.Kernel.Data import GH_Path
import System

# ============================================================
# HoberGlow SECTION EXTRACTOR v1.1 — PHYSICS-GATED
# Robust 11-section extractor for ONE physical member (A or B)
# Rhino 8 / Grasshopper Python 3
#
# INPUTS
#   MemberGeo   : List / GeometryBase or Guid
#   EndAxis1    : Item / Line or linear Curve
#   CenterAxis  : Item / Line or linear Curve
#   EndAxis2    : Item / Line or linear Curve
#   Divisions   : Item / int   (default 5)
#
# OUTPUTS
#   SectionsYZ_mm   : DataTree[Curve]   11 branches, oriented to World YZ
#   SectionsYZ_cm   : DataTree[Curve]   same geometry scaled to cm; ready for Karamba
#   RawSections     : DataTree[Curve]   original section curves in Rhino space
#   SectionPlanes   : List[Plane]       11 actual cutting planes
#   PreviewWall     : DataTree[Curve]   display-only spaced sections
#   CleanSections_cm : DataTree[Curve] candidate continuous beam sections only
#   ReviewSections_cm: DataTree[Curve] disconnected/material-multi-island sections
#   SectionClass     : List[str]        branch classifications
#   Report           : List[str]
#
# NOTES
#   - Two straight FE halves are used: EndAxis1->CenterAxis and CenterAxis->EndAxis2.
#   - 6 samples on first half + 5 samples on second half = 11 unique sections.
#   - Each branch corresponds to exactly ONE section location.
#   - Multiple loops (outer boundary / holes / disconnected fixed parts) stay in that branch.
#   - Curves are polygonised to straight-segment closed polylines.
# ============================================================

SectionsYZ_mm = DataTree[object]()
SectionsYZ_cm = DataTree[object]()
RawSections = DataTree[object]()
PreviewWall = DataTree[object]()
CleanSections_cm = DataTree[object]()
ReviewSections_cm = DataTree[object]()
SectionClass = []
SectionPlanes = []
Report = []


def unwrap(v):
    try:
        if hasattr(v, "Value"):
            v = v.Value
    except:
        pass
    return v


def resolve_geo(v):
    v = unwrap(v)
    if v is None:
        return None

    if isinstance(v, System.Guid):
        doc = Rhino.RhinoDoc.ActiveDoc
        if doc is None:
            return None
        return doc.Objects.FindGeometry(v)

    try:
        if isinstance(v, Rhino.DocObjects.ObjRef):
            return v.Geometry()
    except:
        pass

    return v


def resolve_breps(items):
    if items is None:
        return []

    try:
        vals = list(items)
    except:
        vals = [items]

    out = []

    for item in vals:
        g = resolve_geo(item)
        if g is None:
            continue

        if isinstance(g, rg.Brep):
            out.append(g)
            continue

        try:
            b = rg.Brep.TryConvertBrep(g)
        except:
            b = None

        if b is not None:
            out.append(b)

    return out


def as_line(v, name, tol):
    v = resolve_geo(v)

    if isinstance(v, rg.Line):
        ln = rg.Line(v.From, v.To)

    elif isinstance(v, rg.Curve):
        if not v.IsLinear(tol):
            raise ValueError(
                "{} must be a straight line/curve.".format(name)
            )

        ln = rg.Line(
            v.PointAtStart,
            v.PointAtEnd
        )

    else:
        raise ValueError(
            "{} must resolve to one Line or linear Curve.".format(name)
        )

    if not ln.IsValid or ln.Length <= tol:
        raise ValueError(
            "{} is invalid or too short.".format(name)
        )

    return ln


def line_midpoint(ln):
    return ln.PointAt(0.5)


def stable_section_plane(origin, beam_dir):
    """
    Plane normal = beam_dir.
    Plane XAxis/YAxis lie in the section plane.
    Uses projected World Z as the preferred in-plane vertical direction.
    """

    n = rg.Vector3d(beam_dir)

    if n.IsTiny():
        raise ValueError("Beam direction is zero.")

    n.Unitize()

    seed = rg.Vector3d.ZAxis

    if abs(rg.Vector3d.Multiply(seed, n)) > 0.95:
        seed = rg.Vector3d.YAxis

    # project seed into plane normal to n
    proj = (
        seed
        - n * rg.Vector3d.Multiply(seed, n)
    )

    if proj.IsTiny():
        seed = rg.Vector3d.XAxis
        proj = (
            seed
            - n * rg.Vector3d.Multiply(seed, n)
        )

    proj.Unitize()

    # local z-like in-plane axis
    other = rg.Vector3d.CrossProduct(
        n,
        proj
    )

    if other.IsTiny():
        raise ValueError(
            "Could not construct section frame."
        )

    other.Unitize()

    # cross(proj, other) = n
    return rg.Plane(
        origin,
        proj,
        other
    )


def sample_segment_planes(p0, p1, divisions, include_start, include_end):
    vec = rg.Vector3d(p1 - p0)

    if vec.IsTiny():
        raise ValueError(
            "A beam half has zero length."
        )

    frames = []

    for i in range(divisions + 1):
        if i == 0 and not include_start:
            continue
        if i == divisions and not include_end:
            continue

        t = float(i) / float(divisions)

        p = rg.Point3d(
            p0.X + (p1.X - p0.X) * t,
            p0.Y + (p1.Y - p0.Y) * t,
            p0.Z + (p1.Z - p0.Z) * t,
        )

        frames.append(
            stable_section_plane(
                p,
                vec
            )
        )

    return frames


def intersect_member_with_plane(breps, plane, tol):
    curves = []

    for brep in breps:
        try:
            result = Intersection.BrepPlane(
                brep,
                plane,
                tol
            )
        except Exception:
            result = None

        if not isinstance(result, tuple) or len(result) < 3:
            continue

        ok = result[0]
        crvs = result[1]

        if not ok or crvs is None:
            continue

        for c in crvs:
            if c is not None and c.IsValid:
                curves.append(c.DuplicateCurve())

    if not curves:
        return []

    # Join only where Rhino says curves meet within tolerance.
    # This helps turn face-by-face intersection fragments into closed loops,
    # without flattening different closed loops into one.
    try:
        joined = rg.Curve.JoinCurves(
            curves,
            tol
        )
    except Exception:
        joined = None

    if joined is not None and len(joined) > 0:
        curves = [
            c for c in joined
            if c is not None and c.IsValid
        ]

    return curves


def polygonise_closed_curve(crv, tol):
    """
    Convert a section curve to a straight-segment closed PolylineCurve.
    Uses direct polyline extraction when available; otherwise samples it.
    """
    if crv is None or not crv.IsValid:
        return None

    # direct polyline if already polyline
    try:
        ok, pl = crv.TryGetPolyline()
        if ok and pl is not None and pl.Count >= 3:
            if not pl.IsClosed:
                pl.Add(pl[0])
            return rg.PolylineCurve(pl)
    except Exception:
        pass

    length = crv.GetLength()

    # adaptive but bounded sample count
    n = int(
        max(
            24,
            min(
                160,
                math.ceil(
                    length / max(tol * 20.0, 0.5)
                )
            )
        )
    )

    params = crv.DivideByCount(
        n,
        True
    )

    if params is None or len(params) < 3:
        return None

    pts = [
        crv.PointAt(t)
        for t in params
    ]

    if pts[0].DistanceTo(pts[-1]) > tol:
        pts.append(
            rg.Point3d(pts[0])
        )

    pl = rg.Polyline(pts)

    if pl.Count < 4:
        return None

    return rg.PolylineCurve(pl)


def ensure_loop_orientation_yz(curves, tol):
    """
    Karamba rule:
      CCW seen from +X = material
      CW  seen from +X = hole.

    Determine nesting in the YZ plane:
      even nesting depth -> material loop
      odd nesting depth  -> hole loop.
    """
    valid = []

    for c in curves:
        if c is None or not c.IsValid or not c.IsClosed:
            continue

        amp = rg.AreaMassProperties.Compute(c)

        if amp is None or abs(amp.Area) <= tol * tol:
            continue

        valid.append(c)

    if len(valid) <= 1:
        # single loop: force CCW wrt WorldYZ
        if len(valid) == 1:
            ori = valid[0].ClosedCurveOrientation(
                rg.Plane.WorldYZ
            )
            if ori == rg.CurveOrientation.Clockwise:
                valid[0].Reverse()
        return valid

    # Use area centroid as a robust test point for nesting.
    centroids = []

    for c in valid:
        amp = rg.AreaMassProperties.Compute(c)
        centroids.append(
            amp.Centroid
        )

    depths = []

    for i, pt in enumerate(centroids):
        depth = 0

        for j, other in enumerate(valid):
            if i == j:
                continue

            rel = other.Contains(
                pt,
                rg.Plane.WorldYZ,
                tol
            )

            if rel == rg.PointContainment.Inside:
                depth += 1

        depths.append(depth)

    for c, depth in zip(valid, depths):
        desired_ccw = (
            depth % 2 == 0
        )

        ori = c.ClosedCurveOrientation(
            rg.Plane.WorldYZ
        )

        if desired_ccw:
            if ori == rg.CurveOrientation.Clockwise:
                c.Reverse()
        else:
            if ori == rg.CurveOrientation.CounterClockwise:
                c.Reverse()

    return valid


def classify_oriented_yz_loops(curves):
    """
    After ensure_loop_orientation_yz():
      CCW wrt WorldYZ = material boundary
      CW  wrt WorldYZ = hole boundary

    Returns:
      material_islands, holes, classification
    """
    material = 0
    holes = 0

    for c in curves:
        if c is None or not c.IsValid or not c.IsClosed:
            continue

        ori = c.ClosedCurveOrientation(
            rg.Plane.WorldYZ
        )

        if ori == rg.CurveOrientation.CounterClockwise:
            material += 1
        elif ori == rg.CurveOrientation.Clockwise:
            holes += 1

    if material == 1:
        cls = "CANDIDATE_CONTINUOUS_SECTION"
    elif material == 0:
        cls = "INVALID_NO_MATERIAL_ISLAND"
    else:
        cls = "REVIEW_MULTIPLE_MATERIAL_ISLANDS"

    return material, holes, cls


try:
    doc = Rhino.RhinoDoc.ActiveDoc

    if doc is None:
        raise ValueError(
            "No active Rhino document."
        )

    tol = max(
        float(doc.ModelAbsoluteTolerance),
        1e-8
    )

    breps = resolve_breps(
        MemberGeo
    )

    if len(breps) == 0:
        raise ValueError(
            "MemberGeo contains no resolvable Brep geometry."
        )

    L1 = as_line(
        EndAxis1,
        "EndAxis1",
        tol
    )

    LC = as_line(
        CenterAxis,
        "CenterAxis",
        tol
    )

    L2 = as_line(
        EndAxis2,
        "EndAxis2",
        tol
    )

    p1 = line_midpoint(L1)
    pc = line_midpoint(LC)
    p2 = line_midpoint(L2)

    try:
        divisions = int(Divisions)
    except Exception:
        divisions = 5

    divisions = max(
        2,
        divisions
    )

    # 6 positions on first half including End1 and C.
    first_half = sample_segment_planes(
        p1,
        pc,
        divisions,
        True,
        True
    )

    # 5 positions on second half: omit duplicated C, include End2.
    second_half = sample_segment_planes(
        pc,
        p2,
        divisions,
        False,
        True
    )

    planes = (
        first_half
        +
        second_half
    )

    SectionPlanes = [
        rg.Plane(p)
        for p in planes
    ]

    if len(SectionPlanes) != (
        2 * divisions + 1
    ):
        raise ValueError(
            "Unexpected section-plane count: {}."
            .format(len(SectionPlanes))
        )

    # Rhino unit -> centimetres for Karamba Cross Section Properties.
    unit_scale_to_cm = Rhino.RhinoMath.UnitScale(
        doc.ModelUnitSystem,
        Rhino.UnitSystem.Centimeters
    )

    branch_loop_counts = []
    open_loop_counts = []
    material_counts = []
    hole_counts = []

    for idx, plane in enumerate(
        SectionPlanes
    ):
        path = GH_Path(idx)

        raw = intersect_member_with_plane(
            breps,
            plane,
            tol
        )

        if not raw:
            branch_loop_counts.append(0)
            open_loop_counts.append(0)
            material_counts.append(0)
            hole_counts.append(0)
            SectionClass.append("INVALID_EMPTY_SECTION")
            continue

        # Preserve raw section at original location.
        for c in raw:
            RawSections.Add(
                c.DuplicateCurve(),
                path
            )

        # Move to World YZ using each section's OWN source plane.
        xf = rg.Transform.PlaneToPlane(
            plane,
            rg.Plane.WorldYZ
        )

        yz_poly = []
        open_count = 0

        for c in raw:
            d = c.DuplicateCurve()
            d.Transform(xf)

            poly = polygonise_closed_curve(
                d,
                tol
            )

            if poly is None:
                continue

            if not poly.IsClosed:
                open_count += 1
                continue

            yz_poly.append(poly)

        yz_poly = ensure_loop_orientation_yz(
            yz_poly,
            tol
        )

        material_islands, hole_loops, section_class = (
            classify_oriented_yz_loops(
                yz_poly
            )
        )

        branch_loop_counts.append(
            len(yz_poly)
        )

        open_loop_counts.append(
            open_count
        )

        material_counts.append(
            material_islands
        )

        hole_counts.append(
            hole_loops
        )

        SectionClass.append(
            section_class
        )

        for c in yz_poly:
            # mm/doc-unit oriented version
            SectionsYZ_mm.Add(
                c.DuplicateCurve(),
                path
            )

            # cm version for Karamba
            cm = c.DuplicateCurve()
            cm.Transform(
                rg.Transform.Scale(
                    rg.Point3d.Origin,
                    unit_scale_to_cm
                )
            )

            SectionsYZ_cm.Add(
                cm,
                path
            )

            # Physics gate:
            # only ONE connected material island is allowed to pass
            # automatically to CleanSections_cm. Holes are allowed.
            if material_islands == 1:
                CleanSections_cm.Add(
                    cm.DuplicateCurve(),
                    path
                )
            else:
                ReviewSections_cm.Add(
                    cm.DuplicateCurve(),
                    path
                )

            # Display-only wall in original Rhino units.
            wall = c.DuplicateCurve()
            wall.Transform(
                rg.Transform.Translation(
                    rg.Vector3d(
                        idx * 20.0,
                        0.0,
                        0.0
                    )
                )
            )

            PreviewWall.Add(
                wall,
                path
            )

    Report = [
        "=== HoberGlow SECTION EXTRACTOR v1.1 — PHYSICS-GATED ===",
        "",
        "STATUS: OK",
        "Rhino unit = {}".format(
            doc.ModelUnitSystem
        ),
        "Scale to cm = {:.9f}"
        .format(
            unit_scale_to_cm
        ),
        "",
        "Member Breps = {}"
        .format(
            len(breps)
        ),
        "Divisions per half = {}"
        .format(
            divisions
        ),
        "Unique section locations = {}"
        .format(
            len(SectionPlanes)
        ),
        "",
        "SECTION BRANCHES:",
    ]

    for i, count in enumerate(
        branch_loop_counts
    ):
        Report.append(
            "{:02d}: loops={}, material_islands={}, holes={}, open_rejected={} | {}"
            .format(
                i,
                count,
                material_counts[i],
                hole_counts[i],
                open_loop_counts[i],
                SectionClass[i]
            )
        )

    Report.extend([
        "",
        "OUTPUT USE:",
        "RawSections    = section curves in original Rhino space.",
        "SectionsYZ_mm  = branch-safe World-YZ polylines for visual audit.",
        "SectionsYZ_cm   = ALL branch-safe World-YZ polylines scaled to centimetres.",
        "CleanSections_cm = only branches with exactly ONE material island; holes allowed.",
        "ReviewSections_cm = branches with multiple/no material islands; DO NOT use automatically.",
        "SectionClass    = physics-gate result per branch.",
        "PreviewWall    = DISPLAY ONLY; do not feed to Karamba.",
        "",
        "KARAMBA:",
        "For automatic beam-property extraction, use CleanSections_cm only.",
        "ReviewSections_cm requires explicit physical review (joint hardware, separate sleeve, washer, etc.).",
        "CCW wrt +X = material; CW wrt +X = hole.",
        "",
        "Do not Flatten any section tree.",
        "Multiple disconnected material islands are never accepted automatically.",
        "END."
    ])


except Exception as e:
    SectionsYZ_mm = DataTree[object]()
    SectionsYZ_cm = DataTree[object]()
    RawSections = DataTree[object]()
    PreviewWall = DataTree[object]()
    CleanSections_cm = DataTree[object]()
    ReviewSections_cm = DataTree[object]()
    SectionClass = []
    SectionPlanes = []

    Report = [
        "=== HoberGlow SECTION EXTRACTOR ERROR ===",
        "",
        str(e),
        "",
        "INPUTS:",
        "MemberGeo  : List / GeometryBase or Guid",
        "EndAxis1   : Item / Line or linear Curve",
        "CenterAxis : Item / Line or linear Curve",
        "EndAxis2   : Item / Line or linear Curve",
        "Divisions  : Item / int (default 5)",
    ]
# ---------- end b_section_profile_extractor ----------
a_section_profile_extractor = Python3Script(MemberGeo=b_parts_input, EndAxis1=b_axis_1_input, CenterAxis=center_axis_input, EndAxis2=b_axis_2_input, Divisions=5)  # -> SectionsYZ_mm, SectionsYZ_cm, RawSections, SectionPlanes, PreviewWall, Report, CleanSections_cm, ReviewSections_cm, SectionClass; inputs MemberGeo: list of GeometryBase, EndAxis1: Line, CenterAxis: Line, EndAxis2: Line; same code as b_section_profile_extractor
csprops = CrossSectionPropertiesKaramba3D(Polylines=b_section_profile_extractor.CleanSections_cm)  # -> Area_cm², ZPositionOfCentreOfGravity, Iy_cm⁴, Iz_cm⁴, Iyz_cm⁴, Alpha_rad, Wely_cm³, Wely_cm³_2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
csprops_2 = CrossSectionPropertiesKaramba3D(Polylines=a_section_profile_extractor.CleanSections_cm)  # -> Area_cm², ZPositionOfCentreOfGravity, Iy_cm⁴, Iz_cm⁴, Iyz_cm⁴, Alpha_rad, Wely_cm³, Wely_cm³_2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
a_property_range_1 = APROPERTYRANGE1(tree=csprops.Area_cm², tree_2=csprops.Area_cm², tree_4=csprops.Area_cm², tree_3=csprops.Area_cm²)
a_property_range_2 = APROPERTYRANGE1(tree=csprops.Iy_cm⁴, tree_2=csprops.Iy_cm⁴, tree_4=csprops.Iy_cm⁴, tree_3=csprops.Iy_cm⁴)
a_property_range_3 = APROPERTYRANGE1(tree=csprops.Iz_cm⁴, tree_2=csprops.Iz_cm⁴, tree_4=csprops.Iz_cm⁴, tree_3=csprops.Iz_cm⁴)
b_property_range_1 = APROPERTYRANGE1(tree=csprops_2.Area_cm², tree_2=csprops_2.Area_cm², tree_4=csprops_2.Area_cm², tree_3=csprops_2.Area_cm²)
b_property_range_2 = APROPERTYRANGE1(tree=csprops_2.Iy_cm⁴, tree_2=csprops_2.Iy_cm⁴, tree_4=csprops_2.Iy_cm⁴, tree_3=csprops_2.Iy_cm⁴)
b_property_range_3 = APROPERTYRANGE1(tree=csprops_2.Iz_cm⁴, tree_2=csprops_2.Iz_cm⁴, tree_4=csprops_2.Iz_cm⁴, tree_3=csprops_2.Iz_cm⁴)
a_section_property_1 = Panel(a_property_range_1)
a_section_property_2 = Panel(a_property_range_2)
a_section_property_3 = Panel(a_property_range_3)
b_section_property_1 = Panel(b_property_range_1)
b_section_property_2 = Panel(b_property_range_2)
b_section_property_3 = Panel(b_property_range_3)
beam = ModifyCrossSectionKaramba3D(
    CrossSection=o_section_2,
    Area_cm²=a_section_property_1,
    AreaY_cm²=0.033309,
    AreaZ_cm²=0.033309,
    Iy_cm⁴=a_section_property_2,
    Iz_cm⁴=a_section_property_3,
    Ipp_cm⁴=0.000213,
    mode="Beam")
beam_2 = ModifyCrossSectionKaramba3D(
    CrossSection=o_section,
    Area_cm²=b_section_property_1,
    AreaY_cm²=8134,
    AreaZ_cm²=0.008134,
    Iy_cm⁴=b_section_property_2,
    Iz_cm⁴=b_section_property_3,
    Ipp_cm⁴=1023,
    mode="Beam")
pin_local_y_axis = VectorXYZ(XComponent=500000, YComponent=500000, ZComponent=500000)  # -> Vector, Length
pin_local_z_axis = VectorXYZ(XComponent=0.25, YComponent=0.25, ZComponent=0)  # -> Vector, Length
spring = CrossSectionKaramba3D(
    FamilyNameOfCrossSection="DefaultCroSec",
    CTranslation_kN_m=pin_local_y_axis.Vector,
    CRotation_kNm_rad=pin_local_z_axis.Vector,
    mode="Spring")
proxy_node_0 = Number(0)
proxy_node_2 = Number(2)
proxy_node_3 = Number(3)
proxy_node_5 = Number(5)
support_node_indices = Merge(Data1=proxy_node_0, Data2=proxy_node_2, Data3=proxy_node_3, Data4=proxy_node_5)
indtobeam = CreateLinearElementKaramba3D(
    IndexA=_1_8_geometry_and_topology.A_StartIdx,
    IndexB=_1_8_geometry_and_topology.A_EndIdx,
    Identifier=_1_8_geometry_and_topology.A_IDs,
    CrossSection=beam,
    mode="IndexToBeam",
    GuidGeneratorSeed=-1757695425)  # -> Element, Points, Info
indtobeam_2 = CreateLinearElementKaramba3D(
    IndexA=_1_8_geometry_and_topology.B_StartIdx,
    IndexB=_1_8_geometry_and_topology.B_EndIdx,
    Identifier=_1_8_geometry_and_topology.B_IDs,
    CrossSection=beam_2,
    mode="IndexToBeam",
    GuidGeneratorSeed=-1873669060)  # -> Element, Points, Info
indtobeam_3 = CreateLinearElementKaramba3D(
    IndexA=_1_8_geometry_and_topology.Pin_StartIdx,
    IndexB=_1_8_geometry_and_topology.Pin_EndIdx,
    Identifier=_1_8_geometry_and_topology.Pin_IDs,
    CrossSection=spring,
    ZOrientation=_1_8_geometry_and_topology.PinAxisVecs,
    mode="IndexToBeam",
    GuidGeneratorSeed=-1707100046)  # -> Element, Points, Info
supp = SupportKaramba3D(
    PosInd=support_node_indices,
    Ct_kN_m=Vector(0, 0, 0),
    Cr_kNm_rad=Vector(0, 0, 0),
    menu=[buttons(on, on, on, off, off, off)])
beam_3 = OrientateElemKaramba3D(Beam=indtobeam_3.Element, mode="Beam")
active_elements_5 = Merge(Data1=beam_3, Data2=indtobeam_2.Element, Data3=indtobeam.Element)
concentrated = BeamLoadsKaramba3D(
    BeamIdentifier=graft(sector_load_controller_total_8.LoadBeamIDs),
    LoadCase="LC0",
    ForceVector=graft(sector_load_controller_total_8.LoadVecs),
    TPosition=graft(sector_load_controller_total_8.LoadT),
    mode="Concentrated",
    menu=[buttons(off, on)])
assemble = AssembleModelKaramba3D(
    Elem=flatten(active_elements_5),
    Support=flatten(supp),
    Load=flatten(concentrated),
    LimitDistance_mm=0.005,
    Points=_1_8_geometry_and_topology.NodePts)  # -> Model, Info, Mass_kg, CentreOfGravity, LoadCaseNames
analyse = AnalyseKaramba3D(Model=assemble.Model)  # -> flatten(AnalysedModel), MaximumDisplacement_cm, ResultingForce_kN, ChangeOfElasticEnergy_kNm
react = ReactionForcesKaramba3D(AnalysedModel=analyse.AnalysedModel)  # -> Model, ReactionForces_kN, ReactionMoments_kNm, SupportPosition, SumOfReactionForces_kN, SumOfReactionMoments_kNm, GoverningLoadCaseIndex
_1_maximum_displacement_cm_primary_resul = Panel(analyse.MaximumDisplacement_cm)  # "1 - MAXIMUM DISPLACEMENT [cm] - PRIMARY RESULT"
_2_maximum_resultant_force_kn_design_res = Panel(analyse.ResultingForce_kN)  # "2 - MAXIMUM RESULTANT FORCE [kN] - DESIGN RESPONSE"
_4_elastic_energy_change_knm_stiffness_i = Panel(analyse.ChangeOfElasticEnergy_kNm)  # "4 - ELASTIC ENERGY CHANGE [kNm] - STIFFNESS INDICATOR"
beam_sample_positions_t = Panel("""0
0.25
0.5
0.75
1""")
b_forces = BeamForcesKaramba3D(AnalysedModel=analyse.AnalysedModel, Ts=beam_sample_positions_t)  # -> Model, NormalForce_kN, ShearForceVz_kN, ShearForceVy_kN, TorsionalMomentMt_kNm, flatten(BendingMomentMy_kNm), flatten(BendingMomentMz_kNm), LoadCaseIndex
_3_sum_of_reaction_forces_kn_equilibrium = Panel(react.SumOfReactionForces_kN)  # "3 - SUM OF REACTION FORCES [kN] - EQUILIBRIUM CHECK"
maximum_my = MAXIMUMMy(value=b_forces.BendingMomentMy_kNm)
maximum_n = MAXIMUMMy(value=b_forces.NormalForce_kN)
maximum_vz = MAXIMUMMy(value=b_forces.ShearForceVz_kN)
maximum_vy = MAXIMUMMy(value=b_forces.ShearForceVy_kN)
maximum_mt = MAXIMUMMy(value=b_forces.TorsionalMomentMt_kNm)
maximum_mz = MAXIMUMMy(value=b_forces.BendingMomentMz_kNm)
maximum_my_knm = Panel(maximum_my)
maximum_n_kn = Panel(maximum_n)
maximum_vz_kn = Panel(maximum_vz)
maximum_vy_kn = Panel(maximum_vy)
maximum_mt_knm = Panel(maximum_mt)
maximum_mz_knm = Panel(maximum_mz)

# ==== cluster APROPERTYRANGE1
tree = ClusterInput()
tree_2 = ClusterInput()
tree_3 = ClusterInput()
tree_4 = ClusterInput()
tree_branch = TreeBranch(Tree=tree, Path="{2}", MaintainPaths=True)
tree_branch_2 = TreeBranch(Tree=tree_2, Path="{3}", MaintainPaths=True)
tree_branch_3 = TreeBranch(Tree=tree_3, Path="{7}", MaintainPaths=True)
tree_branch_4 = TreeBranch(Tree=tree_4, Path="{8}", MaintainPaths=True)
merge = Merge(Data1=tree_branch, Data2=tree_branch_2, Data3=tree_branch_4, Data4=tree_branch_3)  # -> flatten(Result)
sort_list = SortList(Keys=flatten(merge))  # -> Keys, ValuesValuesA
list_item = ListItem(List=sort_list.Keys, Index=1, Wrap=True)
list_item_2 = ListItem(List=sort_list.Keys, Index=2, Wrap=True)
average = Average(Input=[list_item_2, list_item])
arithmetic_mean = ClusterOutput(average)

# ==== cluster MAXIMUMMy
value = ClusterInput()
absolute = Absolute(Value=flatten(value))
bounds = Bounds(Numbers=absolute)
deconstruct_domain = DeconstructDomain(Domain=bounds)  # -> Start, End
end = ClusterOutput(deconstruct_domain.End)
